# Grasshopper definition Back Side Kinematics Solver.gh (Grasshopper 0.9.76)
# plug-ins: Python Interpreter, HAL [Base] Student license [1 Year]. Expires in 205 days.

num = Number(Slider(30, range=0..100))
num_2 = Number(Slider(519, range=0..10000))

srf = Surface(<surface referenced from the Rhino model>)
crv = Curve(<curve referenced from the Rhino model>)
crv_2 = Curve(<curve referenced from the Rhino model>)
robot_5_rr_left_left = PythonScript(leftLine=crv, rightLine=crv_2, lineCount=num, pointCount=num_2, surfaceZone=srf)  # -> out, projectedPoints; inputs leftLine: Curve, rightLine: Curve, lineCount: Int32
# ---------- robot_5_rr_left_left: Python ----------
import rhinoscriptsyntax as rs
import Rhino.Geometry as rg
import math

leftLinePts = []
leftLinePts = rs.DivideCurve(leftLine,lineCount, True, True)

rightLinePts=[]
rightLinePts = rs.DivideCurve(rightLine,lineCount, True,True)

zigZags=[]

for i in range(0,lineCount):
        a= rs.AddLine(rightLinePts[i],leftLinePts[i])
        zigZags.append(a)
        b= rs.AddLine(leftLinePts[i],rightLinePts[i+1]),
        zigZags.append(b)

entireZigZag = rs.JoinCurves(zigZags)

pointsOnZigZag = rs.DivideCurve(entireZigZag,pointCount)

centerSurface =rs.SurfaceAreaCentroid(surfaceZone)

#the following is to create a mid point from which to create a projection vector

def Midpoint(sideLine):
    sideLinePts=[]
    sideLinePts= rs.DivideCurve(sideLine,2,True,True)
    return sideLinePts[1]

mdPtRightLn = Midpoint(rightLine)
mdPtLeftLn = Midpoint(leftLine)

middleLn = rs.AddLine(mdPtRightLn,mdPtLeftLn)

cntOfMiddleLn = Midpoint(middleLn)

#create center of Surface to project on

surfaceCenter = rs.SurfaceAreaCentroid(surfaceZone)

#for some reasonthe above is a list which I have to call from

surfaceCenterPt=surfaceCenter[0]

#actual Projection

vectorLine = rs.AddLine(surfaceCenterPt,cntOfMiddleLn)

projectionDirection = rs.VectorCreate(surfaceCenterPt,cntOfMiddleLn)

projectedPoints= rs.ProjectPointToSurface(pointsOnZigZag,surfaceZone,projectionDirection)

#cntLeftLine

#cntRightLine

#rs.VectorCreate(

#rs.ProjectPointToSurface(
# ---------- end robot_5_rr_left_left ----------

srf_2 = Surface(<surface referenced from the Rhino model>)
# Convex Zones
crv_3 = Curve(<curve referenced from the Rhino model>)
crv_4 = Curve(<curve referenced from the Rhino model>)
robot_5_rr_right_left = PythonScript(leftLine=crv_3, rightLine=crv_4, lineCount=num, pointCount=num_2, surfaceZone=srf_2)  # -> out, projectedPoints; inputs leftLine: Curve, rightLine: Curve, lineCount: Int32; same code as robot_5_rr_left_left

srf_3 = Surface(<surface referenced from the Rhino model>)
crv_5 = Curve(<curve referenced from the Rhino model>)
crv_6 = Curve(<curve referenced from the Rhino model>)
robot_8_rr_left_left = PythonScript(leftLine=crv_5, rightLine=crv_6, lineCount=num, pointCount=num_2, surfaceZone=srf_3)  # -> out, projectedPoints; inputs leftLine: Curve, rightLine: Curve, lineCount: Int32; same code as robot_5_rr_left_left

srf_4 = Surface(<surface referenced from the Rhino model>)
crv_7 = Curve(<curve referenced from the Rhino model>)
crv_8 = Curve(<curve referenced from the Rhino model>)
robot_rrl_lower_left_edge = PythonScript(leftLine=crv_7, rightLine=crv_8, lineCount=num, pointCount=num_2, surfaceZone=srf_4)  # -> out, projectedPoints; inputs leftLine: Curve, rightLine: Curve, lineCount: Int32; same code as robot_5_rr_left_left

srf_5 = Surface(<surface referenced from the Rhino model>)
crv_9 = Curve(<curve referenced from the Rhino model>)
crv_10 = Curve(<curve referenced from the Rhino model>)
robot_8_rr_right_left = PythonScript(leftLine=crv_9, rightLine=crv_10, lineCount=num, pointCount=num_2, surfaceZone=srf_5)  # -> out, projectedPoints; inputs leftLine: Curve, rightLine: Curve, lineCount: Int32; same code as robot_5_rr_left_left

srf_6 = Surface(<surface referenced from the Rhino model>)
crv_11 = Curve(<curve referenced from the Rhino model>)
crv_12 = Curve(<curve referenced from the Rhino model>)
robot_8_rr_right_upper_left_edge = PythonScript(leftLine=crv_11, rightLine=crv_12, lineCount=num, pointCount=num_2, surfaceZone=srf_6)  # -> out, projectedPoints; inputs leftLine: Curve, rightLine: Curve, lineCount: Int32; same code as robot_5_rr_left_left

crv_13 = Curve(<curve referenced from the Rhino model>)
srf_7 = Surface(<surface referenced from the Rhino model>)
crv_14 = Curve(<curve referenced from the Rhino model>)
robot_5_rr_left_top = PythonScript(leftLine=crv_14, rightLine=crv_13, lineCount=num, pointCount=num_2, surfaceZone=srf_7)  # -> out, projectedPoints; inputs leftLine: Curve, rightLine: Curve, lineCount: Int32; same code as robot_5_rr_left_left
pt = Point(robot_5_rr_left_top.projectedPoints)

srf_8 = Surface(<surface referenced from the Rhino model>)
crv_15 = Curve(<curve referenced from the Rhino model>)
crv_16 = Curve(<curve referenced from the Rhino model>)
robot_7_rr_left_left = PythonScript(leftLine=crv_15, rightLine=crv_16, lineCount=num, pointCount=num_2, surfaceZone=srf_8)  # -> out, projectedPoints; inputs leftLine: Curve, rightLine: Curve, lineCount: Int32; same code as robot_5_rr_left_left
pt_2 = Point(robot_7_rr_left_left.projectedPoints)

srf_9 = Surface(<surface referenced from the Rhino model>)
crv_17 = Curve(<curve referenced from the Rhino model>)
crv_18 = Curve(<curve referenced from the Rhino model>)
robot_8_rr_left_left_2 = PythonScript(leftLine=crv_17, rightLine=crv_18, lineCount=num, pointCount=num_2, surfaceZone=srf_9)  # -> out, projectedPoints; inputs leftLine: Curve, rightLine: Curve, lineCount: Int32; same code as robot_5_rr_left_left

srf_10 = Surface(<surface referenced from the Rhino model>)
# Robot 5
crv_19 = Curve(<curve referenced from the Rhino model>)
crv_20 = Curve(<curve referenced from the Rhino model>)
# RR Right
robot_5_rr_right_top = PythonScript(leftLine=crv_19, rightLine=crv_20, lineCount=num, pointCount=num_2, surfaceZone=srf_10)  # -> out, projectedPoints; inputs leftLine: Curve, rightLine: Curve, lineCount: Int32; same code as robot_5_rr_left_left

srf_11 = Surface(<surface referenced from the Rhino model>)
crv_21 = Curve(<curve referenced from the Rhino model>)
crv_22 = Curve(<curve referenced from the Rhino model>)
robot_7_rr_right_left = PythonScript(leftLine=crv_21, rightLine=crv_22, lineCount=num, pointCount=num_2, surfaceZone=srf_11)  # -> out, projectedPoints; inputs leftLine: Curve, rightLine: Curve, lineCount: Int32; same code as robot_5_rr_left_left

srf_12 = Surface(<surface referenced from the Rhino model>)
crv_23 = Curve(<curve referenced from the Rhino model>)
crv_24 = Curve(<curve referenced from the Rhino model>)
robot_7_rr_right_left_2 = PythonScript(leftLine=crv_23, rightLine=crv_24, lineCount=num, pointCount=num_2, surfaceZone=srf_12)  # -> out, projectedPoints; inputs leftLine: Curve, rightLine: Curve, lineCount: Int32; same code as robot_5_rr_left_left

srf_13 = Surface(<surface referenced from the Rhino model>)
crv_25 = Curve(<curve referenced from the Rhino model>)
crv_26 = Curve(<curve referenced from the Rhino model>)
robot_5_rr_left_bottom = PythonScript(leftLine=crv_25, rightLine=crv_26, lineCount=num, pointCount=num_2, surfaceZone=srf_13)  # -> out, projectedPoints; inputs leftLine: Curve, rightLine: Curve, lineCount: Int32; same code as robot_5_rr_left_left

srf_14 = Surface(<surface referenced from the Rhino model>)
crv_27 = Curve(<curve referenced from the Rhino model>)
crv_28 = Curve(<curve referenced from the Rhino model>)
robot_5_rr_right_bottom = PythonScript(leftLine=crv_27, rightLine=crv_28, lineCount=num, pointCount=num_2, surfaceZone=srf_14)  # -> out, projectedPoints; inputs leftLine: Curve, rightLine: Curve, lineCount: Int32; same code as robot_5_rr_left_left

srf_15 = Surface(<surface referenced from the Rhino model>)
crv_29 = Curve(<curve referenced from the Rhino model>)
crv_30 = Curve(<curve referenced from the Rhino model>)
robot_7_rr_right_bottom = PythonScript(leftLine=crv_29, rightLine=crv_30, lineCount=num, pointCount=num_2, surfaceZone=srf_15)  # -> out, projectedPoints; inputs leftLine: Curve, rightLine: Curve, lineCount: Int32; same code as robot_5_rr_left_left

srf_16 = Surface(<surface referenced from the Rhino model>)
crv_31 = Curve(<curve referenced from the Rhino model>)
crv_32 = Curve(<curve referenced from the Rhino model>)
robot_7_rr_left_bottom = PythonScript(leftLine=crv_31, rightLine=crv_32, lineCount=num, pointCount=num_2, surfaceZone=srf_16)  # -> out, projectedPoints; inputs leftLine: Curve, rightLine: Curve, lineCount: Int32; same code as robot_5_rr_left_left

srf_17 = Surface(<surface referenced from the Rhino model>)
crv_33 = Curve(<curve referenced from the Rhino model>)
crv_34 = Curve(<curve referenced from the Rhino model>)
# RR Left
robot_8_rr_left_top = PythonScript(leftLine=crv_33, rightLine=crv_34, lineCount=num, pointCount=num_2, surfaceZone=srf_17)  # -> out, projectedPoints; inputs leftLine: Curve, rightLine: Curve, lineCount: Int32; same code as robot_5_rr_left_left

crv_35 = Curve(<curve referenced from the Rhino model>)
srf_18 = Surface(<surface referenced from the Rhino model>)
crv_36 = Curve(<curve referenced from the Rhino model>)
# RR Left
robot_6_rr_left_top = PythonScript(leftLine=crv_36, rightLine=crv_35, lineCount=num, pointCount=num_2, surfaceZone=srf_18)  # -> out, projectedPoints; inputs leftLine: Curve, rightLine: Curve, lineCount: Int32; same code as robot_5_rr_left_left

srf_19 = Surface(<surface referenced from the Rhino model>)
crv_37 = Curve(<curve referenced from the Rhino model>)
crv_38 = Curve(<curve referenced from the Rhino model>)
robot_7_rr_left_bottom_2 = PythonScript(leftLine=crv_37, rightLine=crv_38, lineCount=num, pointCount=num_2, surfaceZone=srf_19)  # -> out, projectedPoints; inputs leftLine: Curve, rightLine: Curve, lineCount: Int32; same code as robot_5_rr_left_left

srf_20 = Surface(<surface referenced from the Rhino model>)
crv_39 = Curve(<curve referenced from the Rhino model>)
crv_40 = Curve(<curve referenced from the Rhino model>)
robot_5_rr_left_right = PythonScript(leftLine=crv_39, rightLine=crv_40, lineCount=num, pointCount=num_2, surfaceZone=srf_20)  # -> out, projectedPoints; inputs leftLine: Curve, rightLine: Curve, lineCount: Int32; same code as robot_5_rr_left_left

srf_21 = Surface(<surface referenced from the Rhino model>)
crv_41 = Curve(<curve referenced from the Rhino model>)
crv_42 = Curve(<curve referenced from the Rhino model>)
# Robot 6
# RR Right
robot_7_rr_right_top = PythonScript(leftLine=crv_41, rightLine=crv_42, lineCount=num, pointCount=num_2, surfaceZone=srf_21)  # -> out, projectedPoints; inputs leftLine: Curve, rightLine: Curve, lineCount: Int32; same code as robot_5_rr_left_left

srf_22 = Surface(<surface referenced from the Rhino model>)
crv_43 = Curve(<curve referenced from the Rhino model>)
crv_44 = Curve(<curve referenced from the Rhino model>)
# Robot 7
# RR Right
robot_7_rr_right_top_2 = PythonScript(leftLine=crv_43, rightLine=crv_44, lineCount=num, pointCount=num_2, surfaceZone=srf_22)  # -> out, projectedPoints; inputs leftLine: Curve, rightLine: Curve, lineCount: Int32; same code as robot_5_rr_left_left

srf_23 = Surface(<surface referenced from the Rhino model>)
crv_45 = Curve(<curve referenced from the Rhino model>)
crv_46 = Curve(<curve referenced from the Rhino model>)
# RR Left
robot_7_rr_left_top = PythonScript(leftLine=crv_45, rightLine=crv_46, lineCount=num, pointCount=num_2, surfaceZone=srf_23)  # -> out, projectedPoints; inputs leftLine: Curve, rightLine: Curve, lineCount: Int32; same code as robot_5_rr_left_left

srf_24 = Surface(<surface referenced from the Rhino model>)
crv_47 = Curve(<curve referenced from the Rhino model>)
crv_48 = Curve(<curve referenced from the Rhino model>)
robot_7_rr_right_bottom_2 = PythonScript(leftLine=crv_47, rightLine=crv_48, lineCount=num, pointCount=num_2, surfaceZone=srf_24)  # -> out, projectedPoints; inputs leftLine: Curve, rightLine: Curve, lineCount: Int32; same code as robot_5_rr_left_left

srf_25 = Surface(<surface referenced from the Rhino model>)
crv_49 = Curve(<curve referenced from the Rhino model>)
crv_50 = Curve(<curve referenced from the Rhino model>)
robot_8_rr_right_right = PythonScript(leftLine=crv_49, rightLine=crv_50, lineCount=num, pointCount=num_2, surfaceZone=srf_25)  # -> out, projectedPoints; inputs leftLine: Curve, rightLine: Curve, lineCount: Int32; same code as robot_5_rr_left_left

srf_26 = Surface(<surface referenced from the Rhino model>)
crv_51 = Curve(<curve referenced from the Rhino model>)
crv_52 = Curve(<curve referenced from the Rhino model>)
robot_8_rr_left_bottom = PythonScript(leftLine=crv_51, rightLine=crv_52, lineCount=num, pointCount=num_2, surfaceZone=srf_26)  # -> out, projectedPoints; inputs leftLine: Curve, rightLine: Curve, lineCount: Int32; same code as robot_5_rr_left_left

srf_27 = Surface(<surface referenced from the Rhino model>)
crv_53 = Curve(<curve referenced from the Rhino model>)
crv_54 = Curve(<curve referenced from the Rhino model>)
# RR Right
robot_8_rr_right_top = PythonScript(leftLine=crv_53, rightLine=crv_54, lineCount=num, pointCount=num_2, surfaceZone=srf_27)  # -> out, projectedPoints; inputs leftLine: Curve, rightLine: Curve, lineCount: Int32; same code as robot_5_rr_left_left

srf_28 = Surface(<surface referenced from the Rhino model>)
crv_55 = Curve(<curve referenced from the Rhino model>)
crv_56 = Curve(<curve referenced from the Rhino model>)
robot_8_rr_right_bottom = PythonScript(leftLine=crv_55, rightLine=crv_56, lineCount=num, pointCount=num_2, surfaceZone=srf_28)  # -> out, projectedPoints; inputs leftLine: Curve, rightLine: Curve, lineCount: Int32; same code as robot_5_rr_left_left

srf_29 = Surface(<surface referenced from the Rhino model>)
crv_57 = Curve(<curve referenced from the Rhino model>)
crv_58 = Curve(<curve referenced from the Rhino model>)
robot_8_rr_left_right_new = PythonScript(leftLine=crv_57, rightLine=crv_58, lineCount=num, pointCount=num_2, surfaceZone=srf_29)  # -> out, projectedPoints; inputs leftLine: Curve, rightLine: Curve, lineCount: Int32; same code as robot_5_rr_left_left

srf_30 = Surface(<surface referenced from the Rhino model>)
crv_59 = Curve(<curve referenced from the Rhino model>)
crv_60 = Curve(<curve referenced from the Rhino model>)
robot_7_rr_right_right = PythonScript(leftLine=crv_59, rightLine=crv_60, lineCount=num, pointCount=num_2, surfaceZone=srf_30)  # -> out, projectedPoints; inputs leftLine: Curve, rightLine: Curve, lineCount: Int32; same code as robot_5_rr_left_left

srf_31 = Surface(<surface referenced from the Rhino model>)
crv_61 = Curve(<curve referenced from the Rhino model>)
crv_62 = Curve(<curve referenced from the Rhino model>)
robot_7_rr_right_right_2 = PythonScript(leftLine=crv_61, rightLine=crv_62, lineCount=num, pointCount=num_2, surfaceZone=srf_31)  # -> out, projectedPoints; inputs leftLine: Curve, rightLine: Curve, lineCount: Int32; same code as robot_5_rr_left_left

# ----
# Robot 8
srf_32 = Surface(<surface referenced from the Rhino model>)
crv_63 = Curve(<curve referenced from the Rhino model>)
crv_64 = Curve(<curve referenced from the Rhino model>)
robot_7_rr_left_bottom_3 = PythonScript(leftLine=crv_63, rightLine=crv_64, lineCount=num, pointCount=num_2, surfaceZone=srf_32)  # -> out, projectedPoints; inputs leftLine: Curve, rightLine: Curve, lineCount: Int32; same code as robot_5_rr_left_left

srf_33 = Surface(<surface referenced from the Rhino model>)
crv_65 = Curve(<curve referenced from the Rhino model>)
crv_66 = Curve(<curve referenced from the Rhino model>)
new_robot_7_rr_right_bottom = PythonScript(leftLine=crv_65, rightLine=crv_66, lineCount=num, pointCount=num_2, surfaceZone=srf_33)  # -> out, projectedPoints; inputs leftLine: Curve, rightLine: Curve, lineCount: Int32; same code as robot_5_rr_left_left

srf_34 = Surface(<surface referenced from the Rhino model>)
crv_67 = Curve(<curve referenced from the Rhino model>)
crv_68 = Curve(<curve referenced from the Rhino model>)
robot_6_rr_left_right = PythonScript(leftLine=crv_67, rightLine=crv_68, lineCount=num, pointCount=num_2, surfaceZone=srf_34)  # -> out, projectedPoints; inputs leftLine: Curve, rightLine: Curve, lineCount: Int32; same code as robot_5_rr_left_left

srf_35 = Surface(<surface referenced from the Rhino model>)
crv_69 = Curve(<curve referenced from the Rhino model>)
crv_70 = Curve(<curve referenced from the Rhino model>)
robot_8_rr_left_right = PythonScript(leftLine=crv_69, rightLine=crv_70, lineCount=num, pointCount=num_2, surfaceZone=srf_35)  # -> out, projectedPoints; inputs leftLine: Curve, rightLine: Curve, lineCount: Int32; same code as robot_5_rr_left_left

srf_36 = Surface(<surface referenced from the Rhino model>)
# RR Left
crv_71 = Curve(<curve referenced from the Rhino model>)
crv_72 = Curve(<curve referenced from the Rhino model>)
robot_5_rr_left_top_right_edge = PythonScript(leftLine=crv_71, rightLine=crv_72, lineCount=num, pointCount=num_2, surfaceZone=srf_36)  # -> out, projectedPoints; inputs leftLine: Curve, rightLine: Curve, lineCount: Int32; same code as robot_5_rr_left_left

srf_37 = Surface(<surface referenced from the Rhino model>)
crv_73 = Curve(<curve referenced from the Rhino model>)
crv_74 = Curve(<curve referenced from the Rhino model>)
robot_5_rr_left_bottom_right_edge = PythonScript(leftLine=crv_73, rightLine=crv_74, lineCount=num, pointCount=num_2, surfaceZone=srf_37)  # -> out, projectedPoints; inputs leftLine: Curve, rightLine: Curve, lineCount: Int32; same code as robot_5_rr_left_left

srf_38 = Surface(<surface referenced from the Rhino model>)
crv_75 = Curve(<curve referenced from the Rhino model>)
crv_76 = Curve(<curve referenced from the Rhino model>)
robot_8_rr_right_right_2 = PythonScript(leftLine=crv_75, rightLine=crv_76, lineCount=num, pointCount=num_2, surfaceZone=srf_38)  # -> out, projectedPoints; inputs leftLine: Curve, rightLine: Curve, lineCount: Int32; same code as robot_5_rr_left_left

srf_39 = Surface(<surface referenced from the Rhino model>)
crv_77 = Curve(<curve referenced from the Rhino model>)
crv_78 = Curve(<curve referenced from the Rhino model>)
robot_8_rr_left_right_2 = PythonScript(leftLine=crv_77, rightLine=crv_78, lineCount=num, pointCount=num_2, surfaceZone=srf_39)  # -> out, projectedPoints; inputs leftLine: Curve, rightLine: Curve, lineCount: Int32; same code as robot_5_rr_left_left

Z = UnitZ(Factor=1)
pt_3 = Point(<point referenced from the Rhino model>)
neg = Negative(Value=Slider(52, range=0..300))
amp = Amplitude(Vector=Z, Amplitude=neg)
move = Move(Geometry=pt_3, Motion=amp)  # -> Geometry, Transform
pt_4 = Point(move.Geometry)

left_edge = Slider(801, range=750..1600)
minus_1 = Button()
# Path Zone
# Shape
plus_1 = Button()
rec = DataRecorder(plus_1, DataLimit=-10, RecordData=True)
rec_2 = DataRecorder(minus_1, DataLimit=-10, RecordData=True)

lng = ListLength(List=flatten(rec_2))  # -> expr("Max(0, (x-1)\2)", Length)
# Increment Left Edge
lng_2 = ListLength(List=flatten(rec))  # -> expr("Max(0, (x-1)\2)", Length)
neg_2 = Negative(Value=lng)
addition = Addition(A=lng_2, B=neg_2)
multiplication = Multiplication(A=addition, B=10)

addition_2 = Addition(A=multiplication, B=left_edge)
panel = Panel(addition_2)

bottom_right_edge = Point(robot_5_rr_left_bottom_right_edge.projectedPoints)
top_right_edge = Point(robot_5_rr_left_top_right_edge.projectedPoints)
bottom = Point(robot_5_rr_left_bottom.projectedPoints)
right = Point(robot_5_rr_left_right.projectedPoints)
top = Point(robot_5_rr_left_top.projectedPoints)
# Robot 6, RR Right
left = Point(robot_5_rr_left_left.projectedPoints)

lower_left_edge = Point(robot_rrl_lower_left_edge.projectedPoints)
right_new_large = Point(robot_8_rr_left_right_new.projectedPoints)
bottom_2 = Point(robot_8_rr_left_bottom.projectedPoints)
right_2 = Point(robot_8_rr_left_right_2.projectedPoints)
top_2 = Point(robot_8_rr_left_top.projectedPoints)
left_2 = Point(robot_8_rr_left_left.projectedPoints)

# ----
# Robot 8, RR Left
upper_left_edge = Point(robot_8_rr_right_upper_left_edge.projectedPoints)
bottom_3 = Point(robot_8_rr_right_bottom.projectedPoints)
right_3 = Point(robot_8_rr_right_right_2.projectedPoints)
top_3 = Point(robot_8_rr_right_top.projectedPoints)
left_3 = Point(robot_8_rr_right_left.projectedPoints)

top_right_edge_2 = Point(robot_8_rr_right_right.projectedPoints)
bottom_4 = Point(robot_5_rr_right_bottom.projectedPoints)
# Robot 5, RR Right
top_4 = Point(robot_5_rr_right_top.projectedPoints)
# Robot 5, RR Left
left_4 = Point(robot_5_rr_right_left.projectedPoints)

bottom_right = Point(robot_7_rr_left_bottom_3.projectedPoints)
bottom_left = Point(robot_7_rr_left_bottom.projectedPoints)
right_4 = Point(robot_8_rr_left_right.projectedPoints)
top_5 = Point(robot_7_rr_left_top.projectedPoints)
# Robot 8, RR Right
left_5 = Point(robot_7_rr_left_left.projectedPoints)

new_bottom = Point(new_robot_7_rr_right_bottom.projectedPoints)
bottom_5 = Point(robot_7_rr_right_bottom.projectedPoints)
right_5 = Point(robot_7_rr_right_right.projectedPoints)
top_6 = Point(robot_7_rr_right_top.projectedPoints)
# Robot 6, RR Left
left_6 = Point(robot_7_rr_right_left.projectedPoints)

top_edge = Slider(1942, range=-2005..2005)
minus_1_2 = Button()
plus_1_2 = Button()
rec_3 = DataRecorder(plus_1_2, DataLimit=-10, RecordData=True)
rec_4 = DataRecorder(minus_1_2, DataLimit=-10, RecordData=True)

lng_3 = ListLength(List=flatten(rec_4))  # -> expr("Max(0, (x-1)\2)", Length)
# Increment Top Edge
lng_4 = ListLength(List=flatten(rec_3))  # -> expr("Max(0, (x-1)\2)", Length)
neg_3 = Negative(Value=lng_3)
addition_3 = Addition(A=lng_4, B=neg_3)
multiplication_2 = Multiplication(A=addition_3, B=10)

addition_4 = Addition(A=multiplication_2, B=top_edge)
panel_2 = Panel(addition_4)

bottom_6 = Point(robot_7_rr_left_bottom_2.projectedPoints)
right_6 = Point(robot_6_rr_left_right.projectedPoints)
top_7 = Point(robot_6_rr_left_top.projectedPoints)
# Robot 7, RR Right
left_7 = Point(robot_8_rr_left_left_2.projectedPoints)

bottom_7 = Point(robot_7_rr_right_bottom_2.projectedPoints)
right_7 = Point(robot_7_rr_right_right_2.projectedPoints)
# Robot 7, RR Left
left_8 = Point(robot_7_rr_right_left_2.projectedPoints)
top_8 = Point(robot_7_rr_right_top_2.projectedPoints)

minus_1_3 = Button()
bottom_edge = Slider(-169, range=-1500..1000)
plus_1_3 = Button()
rec_5 = DataRecorder(plus_1_3, DataLimit=-10, RecordData=True)
rec_6 = DataRecorder(minus_1_3, DataLimit=-10, RecordData=True)

lng_5 = ListLength(List=flatten(rec_6))  # -> expr("Max(0, (x-1)\2)", Length)
# Increment Right Edge
lng_6 = ListLength(List=flatten(rec_5))  # -> expr("Max(0, (x-1)\2)", Length)
neg_4 = Negative(Value=lng_5)
addition_5 = Addition(A=lng_6, B=neg_4)
multiplication_3 = Multiplication(A=addition_5, B=10)

addition_6 = Addition(A=multiplication_3, B=bottom_edge)
panel_3 = Panel(addition_6)

right_edge = Slider(-175, range=-2000..11130)
minus_1_4 = Button()
plus_1_4 = Button()
rec_7 = DataRecorder(plus_1_4, DataLimit=-10, RecordData=True)
rec_8 = DataRecorder(minus_1_4, DataLimit=-10, RecordData=True)

lng_7 = ListLength(List=flatten(rec_8))  # -> expr("Max(0, (x-1)\2)", Length)
# Increment Right Edge
lng_8 = ListLength(List=flatten(rec_7))  # -> expr("Max(0, (x-1)\2)", Length)
neg_5 = Negative(Value=lng_7)
addition_7 = Addition(A=lng_8, B=neg_5)
multiplication_4 = Multiplication(A=addition_7, B=10)

addition_8 = Addition(A=multiplication_4, B=right_edge)
panel_4 = Panel(addition_8)

# ----
# Tool Path
# Origin
# Controls
move_left_right = Slider(-1394, range=-5565..5565)
move_up_down = Slider(-20, range=-2005..2005)
angle_of_projection = Slider(70, range=-360..360)

# ----
# Move Center of Zone
# Explortation
pt_left_side_of_imaginary_plat_base = Point(<point referenced from the Rhino model>)
pt_cent_of_plate_base = Point(<point referenced from the Rhino model>)
pt_cent_of_plate = Point(<point referenced from the Rhino model>)
cluster = Cluster_2(
    G=pt_cent_of_plate,
    G_2=pt_cent_of_plate_base,
    A_3=move_up_down,
    A=pt_cent_of_plate_base,
    B=pt_left_side_of_imaginary_plat_base,
    A_2=move_left_right)  # -> G_4, G_3, V_2, V
moved_up_down_center_of_zone = Move(Geometry=cluster.G_3, Motion=cluster.V_2)  # -> Geometry, Transform

# ----
# Projection
# Direction
cluster_2 = Cluster_4(
    G_3=cluster.G_4,
    G=pt_cent_of_plate_base,
    D=angle_of_projection,
    A=moved_up_down_center_of_zone.Geometry,
    G_2=moved_up_down_center_of_zone.Geometry)

# ----
# Zone Exploration
# Tool Path
# Controls
list = ValueList({"Low Point Count": 0, "High Point Count": 1}, selected="Low Point Count")
high_point_count = Slider(300, range=0..2000)
low_point_count = Slider(103, range=0..2000)
line_count = Slider(18, range=1..100)

# ----
# Tool Angle Toggle
list_2 = ValueList({"0 Degrees": 0, "90 Degrees": 1, "180 Degrees": 2, "270 Degrees": 3}, selected="270 Degrees")

# ----
# Path Preview
# Location
# In Path
list_3 = ValueList({"Check Singularities, Reorientations, Rotation Domain, and Reach": 0, "Check Reach Preview": 1}, selected="Check Reach Preview")
remapped_path = Slider(1, range=0..1)
target_no = Slider(105, range=0..1500)
list_4 = ValueList({"Remapped": 0, "Target Value": 1}, selected="Target Value")
minus_1_5 = Button()
plus_1_5 = Button()
rec_9 = DataRecorder(plus_1_5, DataLimit=-10, RecordData=True)
rec_10 = DataRecorder(minus_1_5, DataLimit=-10, RecordData=True)

# ----
# Tool
# Angle
# Controls
_0_degrees = Slider(46, range=0..360)
_180_degrees = Slider(865, range=0..1000)
_90_degrees = Slider(-99, range=-180..181)

# ----
# Robot And Zone
# Controls
list_5 = ValueList({"Rbt5,\tRRR,\tTop": 0, "Rbt5,\tRRR,\tTop Right Edge": 1, "Rbt5,\tRRR,\tBottom": 2, "Rbt5,\tRRR,\tLeft": 3, "Rbt5,\tRRL,\tTop": 4, "Rbt5,\tRRL,\tTop Right": 5, "Rbt5,\tRRL,\tRight": 6, "Rbt5,\tRRL,\tBottom Right Edge": 7, "Rbt5,\tRRL,\tBottom": 8, "Rbt5,\tRRL,\tLeft": 9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}, selected="Rbt,8\tRRL,\tLower, Left, Edge": 38)
list_6 = ValueList({"Model": 0, "Rob 5, RR Right": 1, "Rob 5, RR Left": 2, "Rob 6, RR Right": 3, "Rob 6, RR Left": 4, "Rob 7, RR Right": 5, "Rob 7, RR Left": 6, "Rob 8, RR Right": 7, "Rob 8, RR Left": 8, "All Robots": 9}, selected="Rob 8, RR Right")

zone_filter = StreamFilter(
    Gate=list_5,
    Stream0=top_4,
    Stream1=top_right_edge_2,
    Stream2=bottom_4,
    Stream3=left_4,
    Stream4=top,
    Stream5=top_right_edge,
    Stream6=right,
    Stream7=bottom_right_edge,
    Stream8=bottom,
    Stream9=left,
    Stream10=top_6,
    Stream11=right_5,
    Stream12=bottom_5,
    Stream13=new_bottom,
    Stream14=left_6,
    Stream15=top_7,
    Stream16=right_6,
    Stream17=bottom_6,
    Stream18=left_7,
    Stream19=top_8,
    Stream20=right_7,
    Stream21=bottom_7,
    Stream22=left_8,
    Stream23=top_5,
    Stream24=right_4,
    Stream25=bottom_right,
    Stream26=bottom_left,
    Stream27=left_5,
    Stream28=top_3,
    Stream29=right_3,
    Stream30=bottom_3,
    Stream31=left_3,
    Stream32=upper_left_edge,
    Stream33=top_2,
    Stream34=right_new_large,
    Stream35=right_2,
    Stream36=bottom_2,
    Stream37=left_2,
    Stream38=lower_left_edge)

# ----
# Sander
# Angle
number_slider = Slider(-45, range=-360..360)
list_7 = ValueList({"-45": 0, "-22.5": 1, "0": 2, "22.5": 3, "45": 4}, selected="0")

# ----
# Robot 5
# RR Right
# RR Left
distance_of_robot_from_plate = Slider(0, range=-20..20)
left_right_shift = Slider(0, range=-100..100)

# ----
# Robot 6
# RR Left
distance_of_robot_from_plate_2 = Slider(0, range=-20..20)
left_right_shift_2 = Slider(0, range=-100..100)

# ----
# Robot Model
distance_of_robot_from_plate_3 = Slider(0, range=0..300)
multiplication_5 = Multiplication(A=Slider(0, range=-3000..3000), B=25.4)
neg_6 = Negative(Value=distance_of_robot_from_plate_3)
multiplication_6 = Multiplication(A=neg_6, B=25.4)
pt_5 = Point(<point referenced from the Rhino model>)
vec = VectorXYZ(XComponent=0, YComponent=multiplication_5, ZComponent=0)  # -> Vector, Length
vec_2 = VectorXYZ(XComponent=multiplication_6, YComponent=0, ZComponent=0)  # -> Vector, Length
move_2 = Move(Geometry=pt_5, Motion=vec_2.Vector)  # -> Geometry, Transform
x_direction_pt = Point(<point referenced from the Rhino model>)
y_direction_point = Point(<point referenced from the Rhino model>)
pt_6 = Point(move_2.Geometry)
move_3 = Move(Geometry=pt_6, Motion=vec.Vector)  # -> Geometry, Transform
pt_7 = Point(move_2.Geometry)
vec2pt = Vector2Pt(PointA=pt_7, PointB=x_direction_pt, Unitize=False)  # -> Vector, Length
vec2pt_2 = Vector2Pt(PointA=pt_6, PointB=y_direction_point, Unitize=False)  # -> Vector, Length
pt_8 = Point(move_2.Geometry)
move_4 = Move(Geometry=pt_6, Motion=vec2pt_2.Vector)  # -> Geometry, Transform
move_5 = Move(Geometry=pt_7, Motion=vec2pt.Vector)  # -> Geometry, Transform
pl_3pt = Plane3Pt(PointA=pt_8, PointB=move_5.Geometry, PointC=move_4.Geometry)

pt_front_of_robot_rr_left = Point(<point referenced from the Rhino model>)
pt_left_of_robot_rr_left = Point(<point referenced from the Rhino model>)
pt_cnt_robot_rr_left = Point(<point referenced from the Rhino model>)
cluster_3 = Cluster(
    G_2=pt_cnt_robot_rr_left,
    A_2=pt_cnt_robot_rr_left,
    B=pt_front_of_robot_rr_left,
    G=pt_front_of_robot_rr_left,
    G_3=pt_left_of_robot_rr_left,
    A=distance_of_robot_from_plate,
    A_4=pt_cnt_robot_rr_left,
    B_2=pt_left_of_robot_rr_left,
    A_3=left_right_shift)  # -> G_5, G_4, G_6
pl_3pt_2 = Plane3Pt(PointA=cluster_3.G_5, PointB=cluster_3.G_4, PointC=cluster_3.G_6)

pt_front_of_robot_rr_right = Point(<point referenced from the Rhino model>)
pt_left_of_robot_rr_right = Point(<point referenced from the Rhino model>)
pt_cnt_robot_rr_right = Point(<point referenced from the Rhino model>)
cluster_4 = Cluster(
    G_2=pt_cnt_robot_rr_right,
    A_2=pt_cnt_robot_rr_right,
    B=pt_front_of_robot_rr_right,
    G=pt_front_of_robot_rr_right,
    G_3=pt_left_of_robot_rr_right,
    A=distance_of_robot_from_plate,
    A_4=pt_cnt_robot_rr_right,
    B_2=pt_left_of_robot_rr_right,
    A_3=left_right_shift)  # -> G_5, G_4, G_6
pl_3pt_3 = Plane3Pt(PointA=cluster_4.G_5, PointB=cluster_4.G_4, PointC=cluster_4.G_6)

# ----
# RR Right
pt_front_of_robot_rr_right_2 = Point(<point referenced from the Rhino model>)
pt_left_of_robot_rr_right_2 = Point(<point referenced from the Rhino model>)
pt_cnt_robot_rr_right_2 = Point(<point referenced from the Rhino model>)
cluster_5 = Cluster(
    G_2=pt_cnt_robot_rr_right_2,
    A_2=pt_cnt_robot_rr_right_2,
    B=pt_front_of_robot_rr_right_2,
    G=pt_front_of_robot_rr_right_2,
    G_3=pt_left_of_robot_rr_right_2,
    A=distance_of_robot_from_plate_2,
    A_4=pt_cnt_robot_rr_right_2,
    B_2=pt_left_of_robot_rr_right_2,
    A_3=left_right_shift_2)  # -> G_5, G_4, G_6
pl_3pt_4 = Plane3Pt(PointA=cluster_5.G_5, PointB=cluster_5.G_4, PointC=cluster_5.G_6)

pt_front_of_robot_rr_left_2 = Point(<point referenced from the Rhino model>)
pt_left_of_robot_rr_left_2 = Point(<point referenced from the Rhino model>)
pt_cnt_robot_rr_left_2 = Point(<point referenced from the Rhino model>)
cluster_6 = Cluster(
    G_2=pt_cnt_robot_rr_left_2,
    A_2=pt_cnt_robot_rr_left_2,
    B=pt_front_of_robot_rr_left_2,
    G=pt_front_of_robot_rr_left_2,
    G_3=pt_left_of_robot_rr_left_2,
    A=distance_of_robot_from_plate_2,
    A_4=pt_cnt_robot_rr_left_2,
    B_2=pt_left_of_robot_rr_left_2,
    A_3=left_right_shift_2)  # -> G_5, G_4, G_6
pl_3pt_5 = Plane3Pt(PointA=cluster_6.G_5, PointB=cluster_6.G_4, PointC=cluster_6.G_6)

# ----
# Robot 7
# RR Right
# RR Left
distance_of_robot_from_plate_4 = Slider(0, range=-20..20)
left_right_shift_3 = Slider(0, range=-100..100)
pt_front_of_robot_rr_left_3 = Point(<point referenced from the Rhino model>)
pt_left_of_robot_rr_left_3 = Point(<point referenced from the Rhino model>)
pt_front_of_robot_rr_right_3 = Point(<point referenced from the Rhino model>)
pt_cnt_robot_rr_left_3 = Point(<point referenced from the Rhino model>)
pt_left_of_robot_rr_right_3 = Point(<point referenced from the Rhino model>)
pt_cnt_robot_rr_right_3 = Point(<point referenced from the Rhino model>)
cluster_7 = Cluster(
    G_2=pt_cnt_robot_rr_left_3,
    A_2=pt_cnt_robot_rr_left_3,
    B=pt_front_of_robot_rr_left_3,
    G=pt_front_of_robot_rr_left_3,
    G_3=pt_left_of_robot_rr_left_3,
    A=distance_of_robot_from_plate_4,
    A_4=pt_cnt_robot_rr_left_3,
    B_2=pt_left_of_robot_rr_left_3,
    A_3=left_right_shift_3)  # -> G_5, G_4, G_6
cluster_8 = Cluster(
    G_2=pt_cnt_robot_rr_right_3,
    A_2=pt_cnt_robot_rr_right_3,
    B=pt_front_of_robot_rr_right_3,
    G=pt_front_of_robot_rr_right_3,
    G_3=pt_left_of_robot_rr_right_3,
    A=distance_of_robot_from_plate_4,
    A_4=pt_cnt_robot_rr_right_3,
    B_2=pt_left_of_robot_rr_right_3,
    A_3=left_right_shift_3)  # -> G_5, G_4, G_6
pl_3pt_6 = Plane3Pt(PointA=cluster_7.G_5, PointB=cluster_7.G_4, PointC=cluster_7.G_6)
pl_3pt_7 = Plane3Pt(PointA=cluster_8.G_5, PointB=cluster_8.G_4, PointC=cluster_8.G_6)

# ----
# Robot 8
# RR Right
# RR Left
distance_of_robot_from_plate_5 = Slider(0, range=-20..20)
left_right_shift_4 = Slider(0, range=-100..100)
pt_front_of_robot_rr_left_4 = Point(<point referenced from the Rhino model>)
pt_left_of_robot_rr_left_4 = Point(<point referenced from the Rhino model>)
pt_cnt_robot_rr_left_4 = Point(<point referenced from the Rhino model>)
pt_front_of_robot_rr_right_4 = Point(<point referenced from the Rhino model>)
pt_left_of_robot_rr_right_4 = Point(<point referenced from the Rhino model>)
pt_cnt_robot_rr_right_4 = Point(<point referenced from the Rhino model>)
cluster_9 = Cluster(
    G_2=pt_cnt_robot_rr_left_4,
    A_2=pt_cnt_robot_rr_left_4,
    B=pt_front_of_robot_rr_left_4,
    G=pt_front_of_robot_rr_left_4,
    G_3=pt_left_of_robot_rr_left_4,
    A=distance_of_robot_from_plate_5,
    A_4=pt_cnt_robot_rr_left_4,
    B_2=pt_left_of_robot_rr_left_4,
    A_3=left_right_shift_4)  # -> G_5, G_4, G_6
cluster_10 = Cluster(
    G_2=pt_cnt_robot_rr_right_4,
    A_2=pt_cnt_robot_rr_right_4,
    B=pt_front_of_robot_rr_right_4,
    G=pt_front_of_robot_rr_right_4,
    G_3=pt_left_of_robot_rr_right_4,
    A=distance_of_robot_from_plate_5,
    A_4=pt_cnt_robot_rr_right_4,
    B_2=pt_left_of_robot_rr_right_4,
    A_3=left_right_shift_4)  # -> G_5, G_4, G_6
pl_3pt_8 = Plane3Pt(PointA=cluster_9.G_5, PointB=cluster_9.G_4, PointC=cluster_9.G_6)
pl_3pt_9 = Plane3Pt(PointA=cluster_10.G_5, PointB=cluster_10.G_4, PointC=cluster_10.G_6)

# ----
# Concave Robots
merge = Merge(
    Data1=pl_3pt_3,
    Data2=pl_3pt_2,
    Data3=pl_3pt_4,
    Data4=pl_3pt_5,
    Data5=pl_3pt_7,
    Data6=pl_3pt_6,
    Data7=pl_3pt_9,
    Data8=pl_3pt_8)
filter = StreamFilter(
    Gate=list_6,
    Stream0=pl_3pt,
    Stream1=pl_3pt_3,
    Stream2=pl_3pt_2,
    Stream3=pl_3pt_4,
    Stream4=pl_3pt_5,
    Stream5=pl_3pt_7,
    Stream6=pl_3pt_6,
    Stream7=pl_3pt_9,
    Stream8=pl_3pt_8,
    Stream9=merge)

base_mesh = Mesh(<mesh referenced from the Rhino model>)
j1_mesh = Mesh([<mesh referenced from the Rhino model> x6])
j2_mesh = Mesh(<mesh referenced from the Rhino model>)
j3_mesh = Mesh([<mesh referenced from the Rhino model> x3])
j4_mesh = Mesh([<mesh referenced from the Rhino model> x3])
j5_mesh = Mesh(<mesh referenced from the Rhino model>)
j6_mesh = Mesh(<mesh referenced from the Rhino model>)
dom = ConstructDomain(DomainStart="-180", DomainEnd="180")
dom_2 = ConstructDomain(DomainStart="-65", DomainEnd="85")
dom_3 = ConstructDomain(DomainStart="-180", DomainEnd="70")
dom_4 = ConstructDomain(DomainStart="-300", DomainEnd="300")
dom_5 = ConstructDomain(DomainStart="-120", DomainEnd="120")
dom_6 = ConstructDomain(DomainStart="-300", DomainEnd="300")
j6forigin = J6FlangeOrigin(<j6 flange origin referenced from the Rhino model>)
payload = Payload(Slider(125, range=0..1000))
ptj1_j2 = IntersectionPointJ1J2(<intersection point j1-j2 referenced from the Rhino model>)
wristpt = WristPoint(<wrist point referenced from the Rhino model>)
ptj2_j3 = IntersectionPointJ2J3(<intersection point j2-j3 referenced from the Rhino model>)
robaxisconf = RobotAxisConfiguration(
    J1RotationDomain=dom,
    J2RotationDomain=dom_2,
    J3RotationDomain=dom_3,
    J4RotationDomain=dom_4,
    J5RotationDomain=dom_5,
    J6RotationDomain=dom_6,
    J1MaximumSpeed=250,
    J2MaximumSpeed=250,
    J3MaximumSpeed=250,
    J4MaximumSpeed=320,
    J5MaximumSpeed=320,
    J6MaximumSpeed=420)  # -> RotationDomains, MaximumJointSpeeds
panel_5 = Panel("""ABB 6650
125/3.2""")
robot_creator = RobotCreator(
    NameS="MyRob",
    RobotBrand=panel_5,
    ControllerTechnology="IRC5",
    ModelPlane=pl_3pt,
    InstancePlaneS=graft(filter),
    BaseMeshes=base_mesh,
    J1Meshes=j1_mesh,
    J2Meshes=j2_mesh,
    J3Meshes=j3_mesh,
    J4Meshes=j4_mesh,
    J5Meshes=j5_mesh,
    J6Meshes=j6_mesh,
    IntersectionPointJ1J2=ptj1_j2,
    IntersectionPointJ2J3=ptj2_j3,
    WristPoint=wristpt,
    J6FlangeOrigin=j6forigin,
    RotationDomains=robaxisconf.RotationDomains,
    Payload=payload)

# ----
# Tool Extension
tool_offset_adjustment_plate_depth = Slider(0, range=0..1)
tool_extension = Slider(24.6, range=0..100)
addition_9 = Addition(A=tool_extension, B=tool_offset_adjustment_plate_depth)

# ----
# Tool Extension
tool_offset_adjustment_plate_depth_2 = Slider(0, range=0..1)
tool_extension_2 = Slider(24.6, range=0..100)
addition_10 = Addition(A=tool_extension_2, B=tool_offset_adjustment_plate_depth_2)

# ----
# Tool Extension
tool_offset_adjustment_plate_depth_3 = Slider(0, range=0..1)
tool_extension_3 = Slider(24.6, range=0..100)
addition_11 = Addition(A=tool_extension_3, B=tool_offset_adjustment_plate_depth_3)

# ----
# Tool Extension
tool_offset_adjustment_plate_depth_4 = Slider(0, range=0..1)
tool_extension_4 = Slider(24.6, range=0..100)
addition_12 = Addition(A=tool_extension_4, B=tool_offset_adjustment_plate_depth_4)

# ----
# Tool Length "OffSet"
tool_length_from_z_axis_of_joint_6 = Slider(18.79, range=10..48)
new_offset = Slider(0, range=0..5)
subtraction = Subtraction(A=tool_length_from_z_axis_of_joint_6, B=new_offset)
panel_6 = Panel(subtraction)

# ----
# Tool Length "OffSet"
tool_length_from_z_axis_of_joint_6_2 = Slider(18.79, range=10..48)
new_offset_2 = Slider(0, range=0..5)
subtraction_2 = Subtraction(A=tool_length_from_z_axis_of_joint_6_2, B=new_offset_2)
panel_7 = Panel(subtraction_2)

# ----
# Tool Length "OffSet"
tool_length_from_z_axis_of_joint_6_3 = Slider(18.79, range=10..48)
new_offset_3 = Slider(0, range=0..5)
subtraction_3 = Subtraction(A=tool_length_from_z_axis_of_joint_6_3, B=new_offset_3)
panel_8 = Panel(subtraction_3)

# ----
# Tool Length "OffSet"
tool_length_from_z_axis_of_joint_6_4 = Slider(18.79, range=10..48)
new_offset_4 = Slider(0, range=0..5)
subtraction_4 = Subtraction(A=tool_length_from_z_axis_of_joint_6_4, B=new_offset_4)
panel_9 = Panel(subtraction_4)

# ----
# Total Tool Length
fixed_sander_tool_offset_inches = Slider(10, range=0..48)
addition_13 = Addition(A=addition_9, B=fixed_sander_tool_offset_inches)
panel_10 = Panel(addition_13)

# ----
# Total Tool Length
fixed_sander_tool_offset_inches_2 = Slider(10, range=0..48)
addition_14 = Addition(A=addition_10, B=fixed_sander_tool_offset_inches_2)
panel_11 = Panel(addition_14)

# ----
# Total Tool Length
fixed_sander_tool_offset_inches_3 = Slider(10, range=0..48)
addition_15 = Addition(A=addition_12, B=fixed_sander_tool_offset_inches_3)
panel_12 = Panel(addition_15)

# ----
# Total Tool Length
fixed_sander_tool_offset_inches_4 = Slider(10, range=0..48)
addition_16 = Addition(A=addition_11, B=fixed_sander_tool_offset_inches_4)
panel_13 = Panel(addition_16)

# ----
# Rbt7 Tool
merge_2 = Merge(Data1=tool_extension, Data2=fixed_sander_tool_offset_inches, Data3=subtraction)
panel_14 = Panel(merge_2)

# ----
# Rbt6 Tool
merge_3 = Merge(Data1=tool_extension_2, Data2=fixed_sander_tool_offset_inches_2, Data3=subtraction_2)
panel_15 = Panel(merge_3)

# ----
# Rbt8 Tool
merge_4 = Merge(Data1=tool_extension_3, Data2=fixed_sander_tool_offset_inches_4, Data3=subtraction_3)
panel_16 = Panel(merge_4)

# ----
# Rbt5 Tool
merge_5 = Merge(Data1=tool_extension_4, Data2=fixed_sander_tool_offset_inches_3, Data3=subtraction_4)
panel_17 = Panel(merge_5)

filter_2 = StreamFilter(
    Gate=list_6,
    Stream1=merge_5,
    Stream2=merge_5,
    Stream3=merge_3,
    Stream4=merge_3,
    Stream5=merge_2,
    Stream6=merge_2,
    Stream7=merge_4,
    Stream8=merge_4)
item = ListItem(List=filter_2, Index=2, Wrap=True)
item_2 = ListItem(List=filter_2, Index=1, Wrap=True)
item_3 = ListItem(List=filter_2, Index=0, Wrap=True)
panel_18 = Panel(item_3)
panel_19 = Panel(item)
panel_20 = Panel(item_2)

# ----
# Collision Objects
mesh_of_plate_flanges_and_dogs = Mesh([<mesh referenced from the Rhino model> x75])
brep_surface_for_orienting_tool = Brep(<brep referenced from the Rhino model>)
mesh = MeshBrep(
    Brep=brep_surface_for_orienting_tool,
    Settings={GridMaxCount=0, GridMinCount=16, JaggedSeams=False, MaxEdgeLength=0, MinEdgeLength=0.0001, MinTolerance=0, Refine=True, RefineAngle=0, RelativeTolerance=0.65, SimplePlanes=True, Tolerance=0})
merge_6 = Merge(Data1=mesh, Data2=mesh_of_plate_flanges_and_dogs)

int = Integer(0)
int_2 = Integer(0)
lng_9 = ListLength(List=flatten([rec_10, int]))  # -> expr("Max(0, (x-1)\2)", Length)
# Increment
# Path Target
lng_10 = ListLength(List=flatten([rec_9, int_2]))  # -> expr("Max(0, (x-1)\2)", Length)
neg_7 = Negative(Value=lng_9)
addition_17 = Addition(A=lng_10, B=neg_7)

panel_21 = Panel(addition_17)
panel_22 = Panel(neg_7)
panel_23 = Panel(lng_10)

# ----
# Adjust Ideal Plate
number_slider_2 = Slider(50, range=0..500)
neg_8 = Negative(Value=number_slider_2)
Z_2 = UnitZ(Factor=neg_8)
X = UnitX(Factor=Slider(25, range=-500..500))
Y = UnitY(Factor=Slider(0, range=-500..500))
srf_40 = Surface(<surface referenced from the Rhino model>)
move_6 = Move(Geometry=srf_40, Motion=Z_2)  # -> Geometry, Transform
move_7 = Move(Geometry=move_6.Geometry, Motion=X)  # -> Geometry, Transform
move_8 = Move(Geometry=move_7.Geometry, Motion=Y)  # -> Geometry, Transform
srf_41 = Surface(move_8.Geometry)

# ----
# Belt Sander Holder
number_slider_3 = Slider(69, range=0..1000)
pt_9 = Point(<point referenced from the Rhino model>)
cluster_11 = Cluster_14(G=pt_9, F=number_slider_3, G_3=pt_9, G_2=pt_9, F_2=number_slider_3, x=number_slider_3)  # -> V, E, y, V_2

# ----
# Zone Exploration
cluster_12 = Cluster_8(
    G=moved_up_down_center_of_zone.Geometry,
    A=moved_up_down_center_of_zone.Geometry,
    D=angle_of_projection,
    x=move_left_right,
    V=cluster.V)  # -> L, R, V_2

# ----
# Rotate Around Center of Zone
move_offset_for_rotating = Move(Geometry=moved_up_down_center_of_zone.Geometry, Motion=cluster_12.V_2)  # -> Geometry, Transform
rotax_center_point_offset_for_vector = RotateAxis(Geometry=move_offset_for_rotating.Geometry, Angle=cluster_12.R, Axis=cluster_12.L)  # -> Geometry, Transform

cluster_13 = Cluster_3(A_2=addition_2, A=moved_up_down_center_of_zone.Geometry, B=rotax_center_point_offset_for_vector.Geometry, x=addition_8)  # -> V, V_2

# ----
# Edge Limits
moved_right_edge_center = Move(Geometry=moved_up_down_center_of_zone.Geometry, Motion=cluster_13.V_2)  # -> Geometry, Transform
moved_left_edge_center = Move(Geometry=moved_up_down_center_of_zone.Geometry, Motion=cluster_13.V)  # -> Geometry, Transform

# ----
# Edge Heights
cluster_14 = Cluster_5(
    F_2=addition_4,
    pt=moved_left_edge_center.Geometry,
    F=addition_6,
    G=moved_right_edge_center.Geometry,
    G_3=moved_right_edge_center.Geometry)  # -> G_2, G_4, G_5, G_6

# ----
# L. and R. Edges
ln_left_edge = Line(StartPoint=cluster_14.G_2, EndPoint=cluster_14.G_4)
ln_right_edge = Line(StartPoint=cluster_14.G_5, EndPoint=cluster_14.G_6)

cluster_15 = Cluster_7(C_2=ln_left_edge, left_line=ln_left_edge, right_line=ln_right_edge, C=ln_right_edge)  # -> L_3, L, left_line_3, right_line_3, L_4, L_2
merge_7 = Merge(
    Data1=cluster_15.L,
    Data2=cluster_15.left_line_3,
    Data3=cluster_15.right_line_3,
    Data4=cluster_15.L_2,
    Data5=cluster_15.L_3,
    Data6=cluster_15.L_4)

divide = DivideCurve(Curve=ln_left_edge, Count=2, Kinks=False)  # -> Points, Tangents, Parameters
divide_2 = DivideCurve(Curve=ln_right_edge, Count=2, Kinks=False)  # -> Points, Tangents, Parameters
item_4 = ListItem(List=divide.Points, Index=2, Wrap=True)
item_5 = ListItem(List=divide.Points, Index=0, Wrap=True)
item_6 = ListItem(List=divide_2.Points, Index=0, Wrap=True)

# ----
# Path
cluster_16 = Cluster_6(C_2=ln_left_edge, N=line_count, C=ln_right_edge, A=line_count)

item_7 = ListItem(List=divide_2.Points, Index=2, Wrap=True)

# ----
# Path Points
join = JoinCurves(Curves=cluster_16, Preserve=False)
filter_3 = StreamFilter(Gate=list, Stream0=low_point_count, Stream1=high_point_count)
divide_3 = DivideCurve(Curve=join, Count=filter_3, Kinks=False)  # -> Points, Tangents, Parameters

# ----
# Projection
projected_curve_edges = Project(Curve=merge_7, Brep=brep_surface_for_orienting_tool, Direction=cluster_2)
project = ProjectPoint(Point=divide_3.Points, Direction=cluster_2, Geometry=brep_surface_for_orienting_tool)  # -> Point, Index

list_8 = ValueList({"Existing Zones": 0, "Zone Exploration": 1}, selected="Existing Zones")
filter_4 = StreamFilter(Gate=list_8, Stream0=zone_filter, Stream1=project.Point)

srf4pt = _4PointSurface(CornerA=item_5, CornerB=item_4, CornerC=item_7, CornerD=item_6)
area = Area(Geometry=srf4pt)  # -> Area, Centroid
panel_24 = Panel(area.Area)

number_slider_4 = Slider(2, range=-2..2)

cluster_17 = Cluster_15(A=number_slider_4, B=Slider(52, range=-180..180))

panel_25 = Panel(cluster_17)

# ----
# Angle of Tool
cluster_18 = Cluster_10(A=_0_degrees, B=_90_degrees, A_2=_0_degrees, B_2=panel_25, A_3=_0_degrees, B_3=_180_degrees, G=list_2, _0=_0_degrees)

# ----
# Analysis:
# Reach and
# Collision
# Detections
list_9 = ValueList({"Collisions Between Robot (etc) and Context": 0, "Collisions Between Robot (etc.) and Tooling": 1, "Collisions Between Robot Arm and Base": 2, "Collisions Between Objects and Robot Arm and Tooling": 3, "Collisions Between Joints": 4}, selected="Collisions Between Robot (etc) and Context")

# ----
# Calc. Max. Area
number_slider_5 = Slider(100000000, range=0..100000000)
galapagos = Galapagos(fitness=subtraction_5, gene=[right_edge, left_edge])

galapagos_2 = Galapagos(fitness=num_3, gene=_0_degrees)

# ----
# Calc. Max. Area
# and Best Angle
# Calc. Tool Angle
number_slider_6 = Slider(10000, range=0..10000)
galapagos_3 = Galapagos(fitness=subtraction_6, gene=[bottom_edge, number_slider_4, left_edge])

# ----
# Toolpath Targets
plane_to_hopefully_set_rotation_of_tool = Plane(Plane(origin=(5603.620095, -5566.124742, -543.302059), x=(-0.3201395074, 0.9473704111, -6.064259164e-07), y=(0.629070833, 0.2125788157, 0.7477166135)))
targetorient = TargetOrientation(
    Method=Slider(4, range=0..10),
    Waypoints=filter_4,
    InstancePlane=PlaneXY(0, 0, 0),
    GuideBrep=brep_surface_for_orienting_tool)
cluster_19 = Cluster_12(A=remapped_path, V=remapped_path, L=targetorient)

addition_18 = Addition(A=addition_17, B=target_no)
filter_5 = StreamFilter(Gate=list_4, Stream0=cluster_19, Stream1=addition_18)
panel_26 = Panel(addition_18)

# ----
# Tool
# Tool Definition
multiplication_7 = Multiplication(A=item_3, B=25.4)
vec_3 = VectorXYZ(XComponent=0, YComponent=0, ZComponent=multiplication_7)  # -> Vector, Length
pt_10 = Point(<point referenced from the Rhino model>)
cluster_20 = Cluster_11(A=item_2, G=pt_10, A_2=item, G_2=pt_10, G_3=pt_10)  # -> R, pt_6, pt_4, pt_5
move_9 = Move(Geometry=pt_10, Motion=vec_3.Vector)  # -> Geometry, Transform
planesrf = PlaneSurface(Plane=move_9.Geometry, XSize=Domain(-10, 10), YSize=Domain(-10, 10))
mass = Mass(40)

# ----
# Rotation of TCP
# Tool/Tool Path
cluster_21 = Cluster_9(G=cluster_20.pt_6, A=cluster_20.pt_6, G_3=cluster_20.pt_5, D=cluster_18, G_2=cluster_20.pt_4)  # -> G_5, G_4

filter_6 = StreamFilter(
    Gate=list_7,
    Stream0=number_slider,
    Stream1=Slider(-22.5, range=-360..360),
    Stream2=Slider(0, range=-360..360),
    Stream3=Slider(22.5, range=-360..360),
    Stream4=Slider(45, range=-360..360))
yz = YZPlane(Origin=cluster_20.pt_6)
sbody = StaticBody([<static body referenced from the Rhino model> x12])
rotate = Rotate(Geometry=sbody, Angle=filter_6, Plane=yz)  # -> Geometry, Transform

item_8 = ListItem(List=targetorient, Index=filter_5, Wrap=True)
filter_7 = StreamFilter(Gate=list_3, Stream0=targetorient, Stream1=item_8)

pl_3pt_10 = Plane3Pt(PointA=cluster_20.pt_6, PointB=cluster_21.G_4, PointC=cluster_21.G_5)

# ----
# Tool Model
addition_19 = Addition(A=multiplication_7, B=cluster_20.R)

# ----
# Belt Sander Extension
cluster_22 = Cluster_13(
    pln=pt_9,
    G=pt_9,
    F=number_slider_3,
    T=cluster_11.V,
    R=number_slider_3,
    F_3=addition_19,
    G_2=pt_9,
    F_2=cluster_11.y,
    T_2=cluster_11.V_2)  # -> R_2, V
extr = Extrude(Base=cluster_22.R_2, Direction=cluster_22.V)

merge_8 = Merge(Data1=rotate.Geometry, Data2=cluster_11.E, Data3=extr)

tool = ToolPreset(
    Name="Tool",
    Number=16,
    FixationPlane=planesrf,
    ToolCenterPoint=pl_3pt_10,
    OnRobot=True,
    Mass=mass,
    StaticBody=merge_8,
    DeactivatedColor=RGBA(255, 165, 0, 200),
    ActivatedColor=RGBA(255, 0, 255, 200),
    ActivatedValue=True,
    DOChannelS="DO_12",
    Language="ABB RAPID")  # -> Tool, Code, FixationPlane, TCP, ToolGeometry

toolpath_creator = ToolpathCreator(Name="TP", Targets=filter_7, Tools=tool.Tool, FlipS=-1, RobID=0)

iksolver = InverseKinematicsSolver(
    RobotPreset=robot_creator,
    Toolpath=toolpath_creator,
    ComputeGeometry=list_3,
    KeepDO=True,
    ErrorDisabled=True,
    LargeReor=90)  # -> JointRotations, OrientedBase, OrientedJoints, OrientedTool, Log, EnvelopeCheck, PathsOut, TotalOut
collisions_solver = CollisionsSolver(
    RobotBase=iksolver.OrientedBase,
    RobotArm=iksolver.OrientedJoints,
    Tool=iksolver.OrientedTool,
    Objects=merge_6,
    Method=list_9,
    BypassContext=False,
    BypassBase=False,
    BypassArm=False,
    BypassTool=False,
    BypassObj=False,
    BypassJ1=True,
    BypassJ4=True)  # -> TestedContext, TestedBase, TestedJoints, TestedJ456, TestedTool, TestedObjects, Log, Collisions
panel_27 = Panel(iksolver.JointRotations)

multiplication_8 = Multiplication(A=iksolver.TotalOut, B=number_slider_5)

subtraction_5 = Subtraction(A=area.Area, B=multiplication_8)
panel_28 = Panel(subtraction_5)

# ----
# Reach, Etc... Problems
flatten = FlattenTree(Tree=iksolver.Log, Path="{0}")
lng_11 = ListLength(List=flatten)
panel_29 = Panel(lng_11)

addition_20 = Addition(A=panel_29, B=Slider(1, range=0..1))
num_3 = Number(addition_20)
panel_30 = Panel(num_3)

multiplication_9 = Multiplication(A=addition_20, B=number_slider_5)
subtraction_6 = Subtraction(A=area.Area, B=multiplication_9)
panel_31 = Panel(subtraction_6)

# ==== cluster Cluster
A = ClusterInput()
A_2 = ClusterInput()
B = ClusterInput()
multiplication = Multiplication(A=A, B=25.4)
A_3 = ClusterInput()
vec2pt = Vector2Pt(PointA=A_2, PointB=B, Unitize=False)  # -> Vector, Length
A_4 = ClusterInput()
B_2 = ClusterInput()
multiplication_2 = Multiplication(A=A_3, B=25.4)
vec2pt_2 = Vector2Pt(PointA=A_4, PointB=B_2, Unitize=False)  # -> Vector, Length
amp = Amplitude(Vector=vec2pt.Vector, Amplitude=multiplication)
amp_2 = Amplitude(Vector=vec2pt_2.Vector, Amplitude=multiplication_2)
G = ClusterInput()
G_2 = ClusterInput()
G_3 = ClusterInput()
addition = Addition(A=amp, B=amp_2)
move_front = Move(Geometry=G, Motion=addition)  # -> Geometry, Transform
move_center = Move(Geometry=G_2, Motion=addition)  # -> Geometry, Transform
move_left = Move(Geometry=G_3, Motion=addition)  # -> Geometry, Transform
G_4 = ClusterOutput(move_front.Geometry)
G_5 = ClusterOutput(move_center.Geometry)
G_6 = ClusterOutput(move_left.Geometry)

# ==== cluster Cluster_2
A = ClusterInput()
B = ClusterInput()
A_2 = ClusterInput()
A_3 = ClusterInput()
G = ClusterInput()
G_2 = ClusterInput()

Z = UnitZ(Factor=1)
vec2pt = Vector2Pt(PointA=A, PointB=B, Unitize=False)  # -> Vector, Length
amp = Amplitude(Vector=vec2pt.Vector, Amplitude=A_2)
amp_2 = Amplitude(Vector=Z, Amplitude=A_3)
move = Move(Geometry=G, Motion=amp)  # -> Geometry, Transform
moved_left_right = Move(Geometry=G_2, Motion=amp)  # -> Geometry, Transform
move_2 = Move(Geometry=move.Geometry, Motion=amp_2)  # -> Geometry, Transform

V = ClusterOutput(vec2pt.Vector)
V_2 = ClusterOutput(amp_2)
G_3 = ClusterOutput(moved_left_right.Geometry)
G_4 = ClusterOutput(move_2.Geometry)

# ==== cluster Cluster_3
A = ClusterInput()
B = ClusterInput()
vec2pt = Vector2Pt(PointA=A, PointB=B, Unitize=False)  # -> Vector, Length
x = ClusterInput()
A_2 = ClusterInput()
neg = Negative(Value=x)
amp = Amplitude(Vector=vec2pt.Vector, Amplitude=A_2)
amp_2 = Amplitude(Vector=vec2pt.Vector, Amplitude=neg)
V = ClusterOutput(amp)
V_2 = ClusterOutput(amp_2)

# ==== cluster Cluster_4
D = ClusterInput()
rad = Radians(Degrees=D)
number_slider = Slider(100, range=0..100)
neg = Negative(Value=number_slider)
X = UnitX(Factor=neg)
Z = UnitZ(Factor=number_slider)
G = ClusterInput()
move = Move(Geometry=G, Motion=X)  # -> Geometry, Transform
G_2 = ClusterInput()
G_3 = ClusterInput()
move_2 = Move(Geometry=G_2, Motion=Z)  # -> Geometry, Transform
A = ClusterInput()
ln = Line(StartPoint=A, EndPoint=move_2.Geometry)
rotax = RotateAxis(Geometry=G_3, Angle=rad, Axis=ln)  # -> Geometry, Transform
rotax_2 = RotateAxis(Geometry=move.Geometry, Angle=rad, Axis=ln)  # -> Geometry, Transform
vec2pt = Vector2Pt(PointA=rotax_2.Geometry, PointB=rotax.Geometry, Unitize=False)  # -> Vector, Length
V = ClusterOutput(vec2pt.Vector)

# ==== cluster Cluster_5
pt = ClusterInput()
F = ClusterInput()
F_2 = ClusterInput()
pt_2 = Point(pt)
Z = UnitZ(Factor=F)
Z_2 = UnitZ(Factor=F_2)
neg = Negative(Value=Z)
move = Move(Geometry=pt_2, Motion=Z_2)  # -> Geometry, Transform
move_2 = Move(Geometry=pt_2, Motion=neg)  # -> Geometry, Transform
G = ClusterInput()
G_2 = ClusterOutput(move.Geometry)
G_3 = ClusterInput()
G_4 = ClusterOutput(move_2.Geometry)
move_3 = Move(Geometry=G, Motion=Z_2)  # -> Geometry, Transform
move_4 = Move(Geometry=G_3, Motion=neg)  # -> Geometry, Transform
G_5 = ClusterOutput(move_3.Geometry)
G_6 = ClusterOutput(move_4.Geometry)

# ==== cluster Cluster_6
A = ClusterInput()
subtraction = Subtraction(A=A, B="\"1\"")
C = ClusterInput()
C_2 = ClusterInput()
N = ClusterInput()
divide = DivideCurve(Curve=C, Count=subtraction, Kinks=False)  # -> Points, Tangents, Parameters
divide_2 = DivideCurve(Curve=C_2, Count=N, Kinks=False)  # -> Points, Tangents, Parameters
weave = Weave(Pattern=[0, 1], Stream0=divide_2.Points, Stream1=divide.Points, NullGaps=False)
shift = ShiftList(List=weave, Shift=1, Wrap=Toggle(False))
ln = Line(StartPoint=weave, EndPoint=shift)
L = ClusterOutput(ln)

# ==== cluster Cluster_7
C = ClusterInput()
C_2 = ClusterInput()
end = EndPoints(Curve=C)  # -> Start, End
end_2 = EndPoints(Curve=C_2)  # -> Start, End
right_line = ClusterInput()
left_line = ClusterInput()
right_line_2 = Curve(right_line)
top_line = Line(StartPoint=end_2.Start, EndPoint=end.Start)
left_line_2 = Curve(left_line)
bottom_line = Line(StartPoint=end_2.End, EndPoint=end.End)
L = ClusterOutput(top_line)
L_2 = ClusterOutput(bottom_line)
left_line_3 = ClusterOutput(left_line_2)
number_slider = Slider(2, range=0..10)
right_line_3 = ClusterOutput(right_line_2)
divide = DivideCurve(Curve=top_line, Count=number_slider, Kinks=False)  # -> Points, Tangents, Parameters
divide_2 = DivideCurve(Curve=left_line_2, Count=number_slider, Kinks=False)  # -> Points, Tangents, Parameters
divide_3 = DivideCurve(Curve=right_line_2, Count=number_slider, Kinks=False)  # -> Points, Tangents, Parameters
divide_4 = DivideCurve(Curve=bottom_line, Count=number_slider, Kinks=False)  # -> Points, Tangents, Parameters
number_slider_2 = Slider(1, range=0..1)
item = ListItem(List=divide.Points, Index=number_slider_2, Wrap=True)
item_2 = ListItem(List=divide_2.Points, Index=number_slider_2, Wrap=True)
item_3 = ListItem(List=divide_3.Points, Index=number_slider_2, Wrap=True)
item_4 = ListItem(List=divide_4.Points, Index=number_slider_2, Wrap=True)

ln = Line(StartPoint=item_2, EndPoint=item_3)
divide_5 = DivideCurve(Curve=ln, Count=number_slider, Kinks=False)  # -> Points, Tangents, Parameters
item_5 = ListItem(List=divide_5.Points, Index=Slider(1, range=0..1), Wrap=True)

ln_2 = Line(StartPoint=item, EndPoint=item_4)
divide_6 = DivideCurve(Curve=ln_2, Count=number_slider, Kinks=False)  # -> Points, Tangents, Parameters
item_6 = ListItem(List=divide_6.Points, Index=Slider(1, range=0..1), Wrap=True)

L_3 = ClusterOutput(ln)
L_4 = ClusterOutput(ln_2)

# ==== cluster Cluster_8
x = ClusterInput()
abs = Absolute(Value=x)
Z = UnitZ(Factor=1)
amp = Amplitude(Vector=Z, Amplitude=Slider(100, range=0..100))
multiplication = Multiplication(A=abs, B=Slider(2, range=0..10))
G = ClusterInput()
V = ClusterInput()
move = Move(Geometry=G, Motion=amp)  # -> Geometry, Transform
amp_2 = Amplitude(Vector=V, Amplitude=multiplication)
A = ClusterInput()
D = ClusterInput()
V_2 = ClusterOutput(amp_2)
ln_rot_axis = Line(StartPoint=A, EndPoint=move.Geometry)
rad = Radians(Degrees=D)
L = ClusterOutput(ln_rot_axis)
R = ClusterOutput(rad)

# ==== cluster Cluster_9
D = ClusterInput()
vec = VectorXYZ(XComponent=Slider(100, range=0..100), YComponent=0, ZComponent=0)  # -> Vector, Length
rad = Radians(Degrees=D)
G = ClusterInput()
move = Move(Geometry=G, Motion=vec.Vector)  # -> Geometry, Transform
G_2 = ClusterInput()
G_3 = ClusterInput()
A = ClusterInput()
ln = Line(StartPoint=A, EndPoint=move.Geometry)
rotax = RotateAxis(Geometry=G_2, Angle=rad, Axis=ln)  # -> Geometry, Transform
rotax_2 = RotateAxis(Geometry=G_3, Angle=rad, Axis=ln)  # -> Geometry, Transform
G_4 = ClusterOutput(rotax.Geometry)
G_5 = ClusterOutput(rotax_2.Geometry)

# ==== cluster Cluster_10
A = ClusterInput()
B = ClusterInput()
A_2 = ClusterInput()
B_2 = ClusterInput()
A_3 = ClusterInput()
B_3 = ClusterInput()
G = ClusterInput()
_0 = ClusterInput()
addition = Addition(A=A, B=B)
addition_2 = Addition(A=A_2, B=B_2)
addition_3 = Addition(A=A_3, B=B_3)
filter = StreamFilter(Gate=G, Stream0=_0, Stream1=addition, Stream2=addition_3, Stream3=addition_2)
s_3 = ClusterOutput(filter)

# ==== cluster Cluster_11
A = ClusterInput()
A_2 = ClusterInput()
multiplication = Multiplication(A=A, B=25.4)
multiplication_2 = Multiplication(A=A_2, B=25.4)
neg = Negative(Value=multiplication)
R = ClusterOutput(multiplication)
addition = Addition(A=neg, B=100)
vec = VectorXYZ(XComponent=multiplication_2, YComponent=0, ZComponent=neg)  # -> Vector, Length
vec_2 = VectorXYZ(XComponent=multiplication_2, YComponent=0, ZComponent=addition)  # -> Vector, Length
vec_3 = VectorXYZ(XComponent=multiplication_2, YComponent=Slider(100, range=0..100), ZComponent=addition)  # -> Vector, Length
G = ClusterInput()
G_2 = ClusterInput()
G_3 = ClusterInput()
move = Move(Geometry=G, Motion=vec.Vector)  # -> Geometry, Transform
move_2 = Move(Geometry=G_2, Motion=vec_2.Vector)  # -> Geometry, Transform
move_3 = Move(Geometry=G_3, Motion=vec_3.Vector)  # -> Geometry, Transform
pt = Point(move_2.Geometry)
pt_2 = Point(move_3.Geometry)
pt_3 = Point(move.Geometry)
pt_4 = ClusterOutput(pt)
pt_5 = ClusterOutput(pt_2)
pt_6 = ClusterOutput(pt_3)

# ==== cluster Cluster_12
L = ClusterInput()
lng = ListLength(List=L)
A = ClusterInput()
multiplication = Multiplication(A=A, B=lng)
panel = Panel(multiplication)
subtraction = Subtraction(A=lng, B="\"1\"")
dom = ConstructDomain(DomainStart="\"0\"", DomainEnd=subtraction)
V = ClusterInput()
remap = RemapNumbers(Value=V, Source=Domain(0, 1), Target=dom)  # -> Mapped, Clipped
round = Round(Number=remap.Mapped)  # -> Nearest, Floor, Ceiling
N = ClusterOutput(round.Nearest)

# ==== cluster Cluster_13
F = ClusterInput()
X = UnitX(Factor=F)
F_2 = ClusterInput()
G = ClusterInput()
X_2 = UnitX(Factor=F_2)
pln = ClusterInput()
move = Move(Geometry=G, Motion=X)  # -> Geometry, Transform
T = ClusterInput()
G_2 = ClusterInput()
pln_2 = Plane(pln)
move_2 = Move(Geometry=move.Geometry, Motion=T)  # -> Geometry, Transform
move_3 = Move(Geometry=G_2, Motion=X_2)  # -> Geometry, Transform
T_2 = ClusterInput()
R = ClusterInput()
move_4 = Move(Geometry=move_3.Geometry, Motion=T_2)  # -> Geometry, Transform
rec_2pt = Rectangle2Pt(Plane=pln_2, PointA=move_2.Geometry, PointB=move_4.Geometry, Radius=R)  # -> Rectangle, Length
R_2 = ClusterOutput(rec_2pt.Rectangle)
F_3 = ClusterInput()
Z = UnitZ(Factor=F_3)
V = ClusterOutput(Z)

# ==== cluster Cluster_14
x = ClusterInput()
F = ClusterInput()
F_2 = ClusterInput()
neg = Negative(Value=x)
Z = UnitZ(Factor=F)
G = ClusterInput()
Y = UnitY(Factor=F_2)
G_2 = ClusterInput()
y = ClusterOutput(neg)
move = Move(Geometry=G, Motion=Z)  # -> Geometry, Transform
V = ClusterOutput(Y)
Z_2 = UnitZ(Factor=neg)
move_2 = Move(Geometry=G_2, Motion=Z_2)  # -> Geometry, Transform
Y_2 = UnitY(Factor=neg)
V_2 = ClusterOutput(Y_2)
move_3 = Move(Geometry=move_2.Geometry, Motion=Y)  # -> Geometry, Transform
G_3 = ClusterInput()
move_4 = Move(Geometry=move.Geometry, Motion=Y)  # -> Geometry, Transform
move_5 = Move(Geometry=G_3, Motion=Y_2)  # -> Geometry, Transform
rec_3pt = Rectangle3Pt(PointA=move_4.Geometry, PointB=move_3.Geometry, PointC=move_5.Geometry)  # -> Rectangle, Length
X = UnitX(Factor=Slider(125, range=0..1000))
extr = Extrude(Base=rec_3pt.Rectangle, Direction=X)
E = ClusterOutput(extr)
move_6 = Move(Geometry=move_2.Geometry, Motion=Y_2)  # -> Geometry, Transform

# ==== cluster Cluster_15
B = ClusterInput()
A = ClusterInput()
multiplication = Multiplication(A=A, B=Slider(22.5, range=0..100))
addition = Addition(A=multiplication, B=B)
R = ClusterOutput(addition)
