# Grasshopper definition Front Side Kinematics Solver v2.gh (Grasshopper 0.9.76)
# plug-ins: HAL [Base] Student license [1 Year]. Expires in 203 days., Python Interpreter, Kangaroo Components

neg = Negative(Value=Slider(0, range=0..500))
Z = UnitZ(Factor=neg)
X = UnitX(Factor=Slider(0, range=-500..500))
Y = UnitY(Factor=Slider(0, range=-500..500))
srf = Surface([<surface referenced from the Rhino model> x2])
move = Move(Geometry=srf, Motion=Z)  # -> Geometry, Transform
move_2 = Move(Geometry=move.Geometry, Motion=X)  # -> Geometry, Transform
move_3 = Move(Geometry=move_2.Geometry, Motion=Y)  # -> Geometry, Transform

timer = Timer(TimerInterval=20, Target=counter)
counter = Counter(Reset=Toggle(True))
panel = Panel(counter)

concave_ideal_srf = Surface(<surface referenced from the Rhino model>)
# Turn on and off robots to conserve processing power
filter = StreamFilter(Gate=0)
srf_2 = Surface(<surface referenced from the Rhino model>)

mesh_of_plate_flanges_and_dogs = Mesh([<mesh referenced from the Rhino model> x79])
brep_surface_for_orienting_tool = Brep(srf_2)
mesh = MeshBrep(
    Brep=brep_surface_for_orienting_tool,
    Settings={GridMaxCount=0, GridMinCount=16, JaggedSeams=False, MaxEdgeLength=0, MinEdgeLength=0.0001, MinTolerance=0, Refine=True, RefineAngle=0, RelativeTolerance=0.65, SimplePlanes=True, Tolerance=0})
# Concave
# Controls
merge = Merge(Data1=mesh, Data2=mesh_of_plate_flanges_and_dogs)

brep = Brep(<brep referenced from the Rhino model>)

minus_1 = Button()
# Move Edges of
# Zone Exploration
plus_1 = Button()
left_edge = Slider(600, range=0..6000)
rec = DataRecorder(minus_1, DataLimit=-10, RecordData=True)
rec_2 = DataRecorder(plus_1, DataLimit=-10, RecordData=True)

lng = ListLength(List=flatten(rec))  # -> expr("Max(0, (x-1)\2)", Length)
# Increment Left Edge
lng_2 = ListLength(List=flatten(rec_2))  # -> expr("Max(0, (x-1)\2)", Length)
neg_2 = Negative(Value=lng)
addition = Addition(A=lng_2, B=neg_2)
multiplication = Multiplication(A=addition, B=10)

addition_2 = Addition(A=multiplication, B=left_edge)
panel_2 = Panel(addition_2)

bottom_edge = Slider(-3200, range=-3500..4010)
minus_1_2 = Button()
plus_1_2 = Button()
rec_3 = DataRecorder(minus_1_2, DataLimit=-10, RecordData=True)
rec_4 = DataRecorder(plus_1_2, DataLimit=-10, RecordData=True)

lng_3 = ListLength(List=flatten(rec_3))  # -> expr("Max(0, (x-1)\2)", Length)
# Increment Right Edge
lng_4 = ListLength(List=flatten(rec_4))  # -> expr("Max(0, (x-1)\2)", Length)
neg_3 = Negative(Value=lng_3)
addition_3 = Addition(A=lng_4, B=neg_3)
multiplication_2 = Multiplication(A=addition_3, B=10)

addition_4 = Addition(A=multiplication_2, B=bottom_edge)
panel_3 = Panel(addition_4)

# ----
# Move Center
# Control
move_up_down = Slider(-1564, range=-2005..2005)
move_left_right = Slider(3867, range=-5565..5565)

# ----
# Number of Points
number_slider = Slider(1500, range=0..10000)
num = Number(Slider(55, range=0..100))
num_2 = Number(number_slider)

minus_1_3 = Button()
plus_1_3 = Button()
top_edge = Slider(3990, range=-2005..5000)
rec_5 = DataRecorder(minus_1_3, DataLimit=-10, RecordData=True)
rec_6 = DataRecorder(plus_1_3, DataLimit=-10, RecordData=True)

lng_5 = ListLength(List=flatten(rec_5))  # -> expr("Max(0, (x-1)\2)", Length)
# Increment Top Edge
lng_6 = ListLength(List=flatten(rec_6))  # -> expr("Max(0, (x-1)\2)", Length)
neg_4 = Negative(Value=lng_5)
addition_5 = Addition(A=lng_6, B=neg_4)
multiplication_3 = Multiplication(A=addition_5, B=10)

addition_6 = Addition(A=multiplication_3, B=top_edge)
panel_4 = Panel(addition_6)

# ----
# Tool Path
# Control Panel
angle_of_projection = Slider(317, range=-360..360)
line_count = Slider(34, range=1..100)

high_point_count = Slider(200, range=0..2000)
low_point_count = Slider(22, range=0..2000)
list = ValueList({"Low Point Count": 0, "High Point Count": 1}, selected="Low Point Count")

# ----
# Move Center of Zone
# Explortation
pt_left_side_of_imaginary_plat_base = Point(<point referenced from the Rhino model>)
pt_cent_of_plate_base = Point(<point referenced from the Rhino model>)
pt_cent_of_plate = Point(<point referenced from the Rhino model>)
cluster = Cluster_8(
    G=pt_cent_of_plate,
    G_2=pt_cent_of_plate_base,
    A_3=move_up_down,
    A=pt_cent_of_plate_base,
    B=pt_left_side_of_imaginary_plat_base,
    A_2=move_left_right)  # -> G_4, G_3, V_2, V
# Zone Exploration
moved_up_down_center_of_zone = Move(Geometry=cluster.G_3, Motion=cluster.V_2)  # -> Geometry, Transform

# ----
# Move Center of Zone
# Explortation
pt_left_side_of_imaginary_plat_base_2 = Point(<point referenced from the Rhino model>)
pt_cent_of_plate_base_2 = Point(<point referenced from the Rhino model>)
pt_cent_of_plate_2 = Point(<point referenced from the Rhino model>)
cluster_2 = Cluster_8(
    G=pt_cent_of_plate_2,
    G_2=pt_cent_of_plate_base_2,
    A_3=move_up_down,
    A=pt_cent_of_plate_base_2,
    B=pt_left_side_of_imaginary_plat_base_2,
    A_2=move_left_right)  # -> G_4, G_3, V_2, V
# Zone Exploration
moved_up_down_center_of_zone_2 = Move(Geometry=cluster_2.G_3, Motion=cluster_2.V_2)  # -> Geometry, Transform

minus_1_4 = Button()
plus_1_4 = Button()
right_edge = Slider(0, range=-5565..5565)
rec_7 = DataRecorder(minus_1_4, DataLimit=-10, RecordData=True)
rec_8 = DataRecorder(plus_1_4, DataLimit=-10, RecordData=True)

lng_7 = ListLength(List=flatten(rec_7))  # -> expr("Max(0, (x-1)\2)", Length)
# Increment Right Edge
lng_8 = ListLength(List=flatten(rec_8))  # -> expr("Max(0, (x-1)\2)", Length)
neg_5 = Negative(Value=lng_7)
addition_7 = Addition(A=lng_8, B=neg_5)
multiplication_4 = Multiplication(A=addition_7, B=10)

addition_8 = Addition(A=multiplication_4, B=right_edge)
panel_5 = Panel(addition_8)

# ----
# Move Center of Zone
# Explortation
pt_left_side_of_imaginary_plat_base_3 = Point(<point referenced from the Rhino model>)
pt_cent_of_plate_base_3 = Point(<point referenced from the Rhino model>)
pt_cent_of_plate_3 = Point(<point referenced from the Rhino model>)
cluster_3 = Cluster_8(
    G=pt_cent_of_plate_3,
    G_2=pt_cent_of_plate_base_3,
    A_3=move_up_down,
    A=pt_cent_of_plate_base_3,
    B=pt_left_side_of_imaginary_plat_base_3,
    A_2=move_left_right)  # -> G_4, G_3, V_2, V
# Zone Exploration
moved_up_down_center_of_zone_3 = Move(Geometry=cluster_3.G_3, Motion=cluster_3.V_2)  # -> Geometry, Transform

# ----
# Move Center of Zone
# Explortation
pt_left_side_of_imaginary_plat_base_4 = Point(<point referenced from the Rhino model>)
pt_cent_of_plate_base_4 = Point(<point referenced from the Rhino model>)
pt_cent_of_plate_4 = Point(<point referenced from the Rhino model>)
cluster_4 = Cluster_8(
    G=pt_cent_of_plate_4,
    G_2=pt_cent_of_plate_base_4,
    A_3=move_up_down,
    A=pt_cent_of_plate_base_4,
    B=pt_left_side_of_imaginary_plat_base_4,
    A_2=move_left_right)  # -> G_4, G_3, V_2, V
# Zone Exploration
moved_up_down_center_of_zone_4 = Move(Geometry=cluster_4.G_3, Motion=cluster_4.V_2)  # -> Geometry, Transform

# ----
# Place in
# Path
list_2 = ValueList({"Check Singularities, Reorientations, Rotation Domain, and Reach": 0, "Check Reach Preview": 1}, selected="Check Reach Preview")
remapped_path = Slider(0.7, range=0..1)
list_3 = ValueList({"Remapped": 0, "Target Value": 1}, selected="Target Value")

# ----
# Place in
# Path
list_4 = ValueList({"Check Singularities, Reorientations, Rotation Domain, and Reach": 0, "Check Reach Preview": 1}, selected="Check Reach Preview")
remapped_path_2 = Slider(0.81, range=0..1)
list_5 = ValueList({"Remapped": 0, "Target Value": 1, "Dynamic": 2}, selected="Target Value")

# ----
# Tool
# Angle
_0_degrees = Slider(47, range=0..360)
_180_degrees = Slider(180, range=0..1000)
other = Slider(106, range=0..1000)
other_2 = Slider(45, range=-180..181)
list_6 = ValueList({"0 Degrees": 0, "90 Degrees": 1, "180 Degrees": 2, "270 Degrees": 3}, selected="90 Degrees")

minus_1_5 = Button()
plus_1_5 = Button()
target_no = Slider(5, range=0..1500)
rec_9 = DataRecorder(plus_1_5, DataLimit=-10, RecordData=True)
rec_10 = DataRecorder(minus_1_5, DataLimit=-10, RecordData=True)

# ----
# Robot #3 Controls
list_7 = ValueList({"Robot 3 Top Zone": 0, "Robot 3 Bottom Zone": 1, "Zone Exploration": 2}, selected="Robot 3 Bottom Zone")

minus_1_6 = Button()
plus_1_6 = Button()
target_no_2 = Slider(0, range=0..1500)
rec_11 = DataRecorder(plus_1_6, DataLimit=-10, RecordData=True)
rec_12 = DataRecorder(minus_1_6, DataLimit=-10, RecordData=True)

# ----
# Tool
# Angle
_0_degrees_2 = Slider(169, range=0..360)
_180_degrees_2 = Slider(179, range=0..1000)
other_3 = Slider(106, range=0..1000)
other_4 = Slider(-93, range=-180..181)
list_8 = ValueList({"0 Degrees": 0, "Other Angle": 1, "180 Degrees": 2, "Other Angle": 3}, selected="0 Degrees")

# ----
# Robot #1 Controls
list_9 = ValueList({"Robot 1 Top Zone": 0, "Robot 1 Bottom Zone": 1, "Zone Exploratin": 2}, selected="Robot 1 Top Zone")

# ----
# Projection
# Direction
cluster_5 = Cluster_10(
    G_3=cluster.G_4,
    G=pt_cent_of_plate_base,
    D=angle_of_projection,
    A=moved_up_down_center_of_zone.Geometry,
    G_2=moved_up_down_center_of_zone.Geometry)

# ----
# Projection
# Direction
cluster_6 = Cluster_10(
    G_3=cluster_2.G_4,
    G=pt_cent_of_plate_base_2,
    D=angle_of_projection,
    A=moved_up_down_center_of_zone_2.Geometry,
    G_2=moved_up_down_center_of_zone_2.Geometry)

# ----
# Projection
# Direction
cluster_7 = Cluster_10(
    G_3=cluster_3.G_4,
    G=pt_cent_of_plate_base_3,
    D=angle_of_projection,
    A=moved_up_down_center_of_zone_3.Geometry,
    G_2=moved_up_down_center_of_zone_3.Geometry)

# ----
# Projection
# Direction
cluster_8 = Cluster_10(
    G_3=cluster_4.G_4,
    G=pt_cent_of_plate_base_4,
    D=angle_of_projection,
    A=moved_up_down_center_of_zone_4.Geometry,
    G_2=moved_up_down_center_of_zone_4.Geometry)

# ----
# Place in
# Path
list_10 = ValueList({"Check Singularities, Reorientations, Rotation Domain, and Reach": 0, "Check Reach Preview": 1}, selected="Check Reach Preview")
remapped_path_3 = Slider(0, range=0..1)
list_11 = ValueList({"Remapped": 0, "Target Value": 1}, selected="Target Value")

# ----
# Place in
# Path
list_12 = ValueList({"Check Singularities, Reorientations, Rotation Domain, and Reach": 0, "Check Reach Preview": 1}, selected="Check Reach Preview")
remapped_path_4 = Slider(0.4, range=0..1)
list_13 = ValueList({"Remapped": 0, "Target Value": 1}, selected="Target Value")

minus_1_7 = Button()
plus_1_7 = Button()
target_no_3 = Slider(870, range=0..1500)
rec_13 = DataRecorder(plus_1_7, DataLimit=-10, RecordData=True)
rec_14 = DataRecorder(minus_1_7, DataLimit=-10, RecordData=True)

# ----
# Robot #4 Controls
list_14 = ValueList({"Robot 4 Top Zone": 0, "Robot 4 Bottom Zone": 1, "Zone Exploration": 2}, selected="Robot 4 Top Zone")

# ----
# Tool
# Angle
_0_degrees_3 = Slider(233, range=0..360)
_180_degrees_3 = Slider(0, range=0..1000)
other_5 = Slider(106, range=0..1000)
other_6 = Slider(65, range=-60..75)
list_15 = ValueList({"0 Degrees": 0, "90 Degrees": 1, "180 Degrees": 2, "270 Degrees": 3}, selected="90 Degrees")

minus_1_8 = Button()
plus_1_8 = Button()
target_no_4 = Slider(396, range=0..1500)
rec_15 = DataRecorder(plus_1_8, DataLimit=-10, RecordData=True)
rec_16 = DataRecorder(minus_1_8, DataLimit=-10, RecordData=True)

# ----
# Tool
# Angle
other_7 = Slider(106, range=0..1000)
_0_degrees_4 = Slider(270, range=0..360)
_180_degrees_4 = Slider(180, range=0..1000)
other_8 = Slider(90, range=-180..181)
list_16 = ValueList({"0 Degrees": 0, "Other Angle": 1, "180 Degrees": 2, "Other Angle": 3}, selected="Other Angle")

# ----
# Robot #2 Controls
list_17 = ValueList({"Robot 2 Top Zone": 0, "Robot 2 Bottom Zone": 1, "Zone Exploration"}, selected="Robot 2 Top Zone")

lng_9 = ListLength(List=flatten(rec_10))  # -> expr("Max(0, (x-1)\2)", Length)
lng_10 = ListLength(List=flatten(rec_9))  # -> expr("Max(0, (x-1)\2)", Length)
neg_6 = Negative(Value=lng_9)
addition_9 = Addition(A=lng_10, B=neg_6)
multiplication_5 = Multiplication(A=addition_9, B=1)
addition_10 = Addition(A=multiplication_5, B=target_no)
panel_6 = Panel(addition_10)

lng_11 = ListLength(List=flatten(rec_12))  # -> expr("Max(0, (x-1)\2)", Length)
lng_12 = ListLength(List=flatten(rec_11))  # -> expr("Max(0, (x-1)\2)", Length)
neg_7 = Negative(Value=lng_11)
addition_11 = Addition(A=lng_12, B=neg_7)
multiplication_6 = Multiplication(A=addition_11, B=1)
addition_12 = Addition(A=multiplication_6, B=target_no_2)
panel_7 = Panel(addition_12)

lng_13 = ListLength(List=flatten(rec_14))  # -> expr("Max(0, (x-1)\2)", Length)
lng_14 = ListLength(List=flatten(rec_13))  # -> expr("Max(0, (x-1)\2)", Length)
neg_8 = Negative(Value=lng_13)
addition_13 = Addition(A=lng_14, B=neg_8)
multiplication_7 = Multiplication(A=addition_13, B=1)
addition_14 = Addition(A=multiplication_7, B=target_no_3)
panel_8 = Panel(addition_14)

lng_15 = ListLength(List=flatten(rec_16))  # -> expr("Max(0, (x-1)\2)", Length)
lng_16 = ListLength(List=flatten(rec_15))  # -> expr("Max(0, (x-1)\2)", Length)
neg_9 = Negative(Value=lng_15)
addition_15 = Addition(A=lng_16, B=neg_9)
multiplication_8 = Multiplication(A=addition_15, B=1)
addition_16 = Addition(A=multiplication_8, B=target_no_4)
panel_9 = Panel(addition_16)

dam = DataDam(BufferDelay=10000000, BufferMode=0)

# ----
# Tool Length "OffSet"
tool_length_from_z_axis_of_joint_6 = Slider(18, range=10..48)
new_offset = Slider(0, range=0..5)
subtraction = Subtraction(A=tool_length_from_z_axis_of_joint_6, B=new_offset)
panel_10 = Panel(subtraction)

# ----
# Tool Extension
tool_offset_adjustment_plate_depth = Slider(0, range=0..1)
tool_extension = Slider(0, range=0..100)
addition_17 = Addition(A=tool_extension, B=tool_offset_adjustment_plate_depth)

dom = ConstructDomain(DomainStart="-180", DomainEnd="180")
dom_2 = ConstructDomain(DomainStart="-70", DomainEnd="70")
dom_3 = ConstructDomain(DomainStart="-28", DomainEnd="105")
dom_4 = ConstructDomain(DomainStart="-300", DomainEnd="300")
dom_5 = ConstructDomain(DomainStart="-120", DomainEnd="120")
dom_6 = ConstructDomain(DomainStart="-300", DomainEnd="300")

# ----
# Tool Length "OffSet"
tool_length_from_z_axis_of_joint_6_2 = Slider(18, range=10..48)
new_offset_2 = Slider(0, range=0..5)
subtraction_2 = Subtraction(A=tool_length_from_z_axis_of_joint_6_2, B=new_offset_2)
panel_11 = Panel(subtraction_2)

dom_7 = ConstructDomain(DomainStart="-180", DomainEnd="180")
dom_8 = ConstructDomain(DomainStart="-70", DomainEnd="70")
dom_9 = ConstructDomain(DomainStart="-28", DomainEnd="105")
dom_10 = ConstructDomain(DomainStart="-300", DomainEnd="300")
dom_11 = ConstructDomain(DomainStart="-120", DomainEnd="120")
dom_12 = ConstructDomain(DomainStart="-300", DomainEnd="300")

j6forigin = J6FlangeOrigin(<j6 flange origin referenced from the Rhino model>)
wristpt = WristPoint(<wrist point referenced from the Rhino model>)
ptj1_j2 = IntersectionPointJ1J2(<intersection point j1-j2 referenced from the Rhino model>)
ptj2_j3 = IntersectionPointJ2J3(<intersection point j2-j3 referenced from the Rhino model>)

base_mesh = Mesh(<mesh referenced from the Rhino model>)
j1_mesh = Mesh([<mesh referenced from the Rhino model> x4])
j2_mesh = Mesh([<mesh referenced from the Rhino model> x11])
j3_mesh = Mesh([<mesh referenced from the Rhino model> x3])
j4_mesh = Mesh([<mesh referenced from the Rhino model> x32])
j5_mesh = Mesh([<mesh referenced from the Rhino model> x15])
j6_mesh = Mesh([<mesh referenced from the Rhino model> x2])

# ----
# Tool Extension
tool_offset_adjustment_plate_depth_2 = Slider(0, range=0..1)
tool_extension_2 = Slider(0, range=0..100)
addition_18 = Addition(A=tool_extension_2, B=tool_offset_adjustment_plate_depth_2)

# ----
# Total Tool Length
fixed_sander_tool_offset_inches = Slider(10, range=0..48)
addition_19 = Addition(A=addition_18, B=fixed_sander_tool_offset_inches)
panel_12 = Panel(addition_19)

crv = Curve(<curve referenced from the Rhino model>)
srf_3 = Surface(<surface referenced from the Rhino model>)
crv_2 = Curve(<curve referenced from the Rhino model>)
top = PythonScript(leftLine=crv_2, rightLine=crv, lineCount=num, pointCount=num_2, surfaceZone=srf_3)  # -> out, projectedPoints; inputs leftLine: Curve, rightLine: Curve, lineCount: Int32
# ---------- top: Python ----------
import rhinoscriptsyntax as rs
import Rhino.Geometry as rg
import math

leftLinePts = []
leftLinePts = rs.DivideCurve(leftLine,lineCount, True, True)

rightLinePts=[]
rightLinePts = rs.DivideCurve(rightLine,lineCount, True,True)

zigZags=[]

for i in range(0,lineCount):
        a= rs.AddLine(rightLinePts[i],leftLinePts[i])
        zigZags.append(a)
        b= rs.AddLine(leftLinePts[i],rightLinePts[i+1]),
        zigZags.append(b)

entireZigZag = rs.JoinCurves(zigZags)

pointsOnZigZag = rs.DivideCurve(entireZigZag,pointCount)

centerSurface =rs.SurfaceAreaCentroid(surfaceZone)

#the following is to create a mid point from which to create a projection vector

def Midpoint(sideLine):
    sideLinePts=[]
    sideLinePts= rs.DivideCurve(sideLine,2,True,True)
    return sideLinePts[1]

mdPtRightLn = Midpoint(rightLine)
mdPtLeftLn = Midpoint(leftLine)

middleLn = rs.AddLine(mdPtRightLn,mdPtLeftLn)

cntOfMiddleLn = Midpoint(middleLn)

#create center of Surface to project on

surfaceCenter = rs.SurfaceAreaCentroid(surfaceZone)

#for some reasonthe above is a list which I have to call from

surfaceCenterPt=surfaceCenter[0]

#actual Projection

vectorLine = rs.AddLine(surfaceCenterPt,cntOfMiddleLn)

projectionDirection = rs.VectorCreate(surfaceCenterPt,cntOfMiddleLn)

projectedPoints= rs.ProjectPointToSurface(pointsOnZigZag,surfaceZone,projectionDirection)

#cntLeftLine

#cntRightLine

#rs.VectorCreate(

#rs.ProjectPointToSurface(
# ---------- end top ----------
pt = Point(top.projectedPoints)

payload = Payload(Slider(125, range=0..1000))

j6forigin_2 = J6FlangeOrigin(<j6 flange origin referenced from the Rhino model>)
wristpt_2 = WristPoint(<wrist point referenced from the Rhino model>)
ptj1_j2_2 = IntersectionPointJ1J2(<intersection point j1-j2 referenced from the Rhino model>)
ptj2_j3_2 = IntersectionPointJ2J3(<intersection point j2-j3 referenced from the Rhino model>)

srf_4 = Surface(<surface referenced from the Rhino model>)
crv_3 = Curve(<curve referenced from the Rhino model>)
crv_4 = Curve(<curve referenced from the Rhino model>)
bottom = PythonScript(leftLine=crv_3, rightLine=crv_4, lineCount=num, pointCount=num_2, surfaceZone=srf_4)  # -> out, projectedPoints; inputs leftLine: Curve, rightLine: Curve, lineCount: Int32; same code as top
pt_2 = Point(bottom.projectedPoints)

base_mesh_2 = Mesh(<mesh referenced from the Rhino model>)
j1_mesh_2 = Mesh([<mesh referenced from the Rhino model> x4])
j2_mesh_2 = Mesh([<mesh referenced from the Rhino model> x11])
j3_mesh_2 = Mesh([<mesh referenced from the Rhino model> x3])
j4_mesh_2 = Mesh([<mesh referenced from the Rhino model> x32])
j5_mesh_2 = Mesh([<mesh referenced from the Rhino model> x15])
j6_mesh_2 = Mesh([<mesh referenced from the Rhino model> x2])

# ----
# Robot Base #2
pt_3 = Point(<point referenced from the Rhino model>)
pt_4 = Point(<point referenced from the Rhino model>)
pt_5 = Point(<point referenced from the Rhino model>)
pl_3pt = Plane3Pt(PointA=pt_4, PointB=pt_3, PointC=pt_5)

crv_5 = Curve(<curve referenced from the Rhino model>)
srf_5 = Surface(<surface referenced from the Rhino model>)
crv_6 = Curve(<curve referenced from the Rhino model>)
top_2 = PythonScript(leftLine=crv_6, rightLine=crv_5, lineCount=num, pointCount=num_2, surfaceZone=srf_5)  # -> out, projectedPoints; inputs leftLine: Curve, rightLine: Curve, lineCount: Int32; same code as top
pt_6 = Point(top_2.projectedPoints)

srf_6 = Surface(<surface referenced from the Rhino model>)
crv_7 = Curve(<curve referenced from the Rhino model>)
crv_8 = Curve(<curve referenced from the Rhino model>)
bottom_2 = PythonScript(leftLine=crv_7, rightLine=crv_8, lineCount=num, pointCount=num_2, surfaceZone=srf_6)  # -> out, projectedPoints; inputs leftLine: Curve, rightLine: Curve, lineCount: Int32; same code as top
pt_7 = Point(bottom_2.projectedPoints)

payload_2 = Payload(Slider(125, range=0..1000))

# ----
# Robot Base #1
pt_8 = Point(<point referenced from the Rhino model>)
pt_9 = Point(<point referenced from the Rhino model>)
pt_10 = Point(<point referenced from the Rhino model>)
pl_3pt_2 = Plane3Pt(PointA=pt_9, PointB=pt_8, PointC=pt_10)

# ----
# Robot Base #3
pt_11 = Point(<point referenced from the Rhino model>)
pt_12 = Point(<point referenced from the Rhino model>)
pt_13 = Point(<point referenced from the Rhino model>)
pl_3pt_3 = Plane3Pt(PointA=pt_12, PointB=pt_11, PointC=pt_13)

# ----
# Total Tool Length
fixed_sander_tool_offset_inches_2 = Slider(10, range=0..48)
addition_20 = Addition(A=addition_17, B=fixed_sander_tool_offset_inches_2)
panel_13 = Panel(addition_20)

# ----
# Robot #2
pt_14 = Point(<point referenced from the Rhino model>)
panel_14 = Panel("""ABB 6400
150/2.8""")
robaxisconf = RobotAxisConfiguration(
    J1RotationDomain=dom_7,
    J2RotationDomain=dom_8,
    J3RotationDomain=dom_9,
    J4RotationDomain=dom_10,
    J5RotationDomain=dom_11,
    J6RotationDomain=dom_12,
    J1MaximumSpeed=250,
    J2MaximumSpeed=250,
    J3MaximumSpeed=250,
    J4MaximumSpeed=320,
    J5MaximumSpeed=320,
    J6MaximumSpeed=420)  # -> RotationDomains, MaximumJointSpeeds
xy = XYPlane(Origin=pt_14)
robot_creator = RobotCreator(
    NameS="MyRob",
    RobotBrand=panel_14,
    ControllerTechnology="IRC5",
    ModelPlane=xy,
    InstancePlaneS=pl_3pt,
    BaseMeshes=base_mesh,
    J1Meshes=j1_mesh,
    J2Meshes=j2_mesh,
    J3Meshes=j3_mesh,
    J4Meshes=j4_mesh,
    J5Meshes=j5_mesh,
    J6Meshes=j6_mesh,
    IntersectionPointJ1J2=ptj1_j2,
    IntersectionPointJ2J3=ptj2_j3,
    WristPoint=wristpt,
    J6FlangeOrigin=j6forigin,
    RotationDomains=robaxisconf.RotationDomains,
    Payload=payload)

# ----
# Robot #1
pt_15 = Point(<point referenced from the Rhino model>)
robaxisconf_2 = RobotAxisConfiguration(
    J1RotationDomain=dom,
    J2RotationDomain=dom_2,
    J3RotationDomain=dom_3,
    J4RotationDomain=dom_4,
    J5RotationDomain=dom_5,
    J6RotationDomain=dom_6,
    J1MaximumSpeed=250,
    J2MaximumSpeed=250,
    J3MaximumSpeed=250,
    J4MaximumSpeed=320,
    J5MaximumSpeed=320,
    J6MaximumSpeed=420)  # -> RotationDomains, MaximumJointSpeeds
panel_15 = Panel("""ABB 6400
75/3.0""")
xy_2 = XYPlane(Origin=pt_15)
robot_creator_2 = RobotCreator(
    NameS="MyRob",
    RobotBrand=panel_15,
    ControllerTechnology="IRC5",
    ModelPlane=xy_2,
    InstancePlaneS=pl_3pt_2,
    BaseMeshes=base_mesh_2,
    J1Meshes=j1_mesh_2,
    J2Meshes=j2_mesh_2,
    J3Meshes=j3_mesh_2,
    J4Meshes=j4_mesh_2,
    J5Meshes=j5_mesh_2,
    J6Meshes=j6_mesh_2,
    IntersectionPointJ1J2=ptj1_j2_2,
    IntersectionPointJ2J3=ptj2_j3_2,
    WristPoint=wristpt_2,
    J6FlangeOrigin=j6forigin_2,
    RotationDomains=robaxisconf_2.RotationDomains,
    Payload=payload_2)

# ----
# Robot Base #4
pt_16 = Point(<point referenced from the Rhino model>)
pt_17 = Point(<point referenced from the Rhino model>)
pt_18 = Point(<point referenced from the Rhino model>)
pl_3pt_4 = Plane3Pt(PointA=pt_17, PointB=pt_16, PointC=pt_18)

merge_2 = Merge(Data1=pl_3pt_3, Data2=pl_3pt_4)

# ----
# Robot #3 and 4
panel_16 = Panel("180")
base_mesh_3 = Mesh(<mesh referenced from the Rhino model>)
j1_mesh_3 = Mesh([<mesh referenced from the Rhino model> x6])
j2_mesh_3 = Mesh(<mesh referenced from the Rhino model>)
j3_mesh_3 = Mesh([<mesh referenced from the Rhino model> x3])
j4_mesh_3 = Mesh([<mesh referenced from the Rhino model> x3])
j5_mesh_3 = Mesh(<mesh referenced from the Rhino model>)
j6_mesh_3 = Mesh(<mesh referenced from the Rhino model>)
dom_13 = ConstructDomain(DomainStart="-180", DomainEnd=panel_16)
dom_14 = ConstructDomain(DomainStart="-65", DomainEnd="85")
dom_15 = ConstructDomain(DomainStart="-180", DomainEnd="70")
dom_16 = ConstructDomain(DomainStart="-300", DomainEnd="300")
dom_17 = ConstructDomain(DomainStart="-120", DomainEnd="120")
dom_18 = ConstructDomain(DomainStart="-300", DomainEnd="300")
j6forigin_3 = J6FlangeOrigin(<j6 flange origin referenced from the Rhino model>)
payload_3 = Payload(Slider(125, range=0..1000))
ptj1_j2_3 = IntersectionPointJ1J2(<intersection point j1-j2 referenced from the Rhino model>)
wristpt_3 = WristPoint(<wrist point referenced from the Rhino model>)
ptj2_j3_3 = IntersectionPointJ2J3(<intersection point j2-j3 referenced from the Rhino model>)
robaxisconf_3 = RobotAxisConfiguration(
    J1RotationDomain=dom_13,
    J2RotationDomain=dom_14,
    J3RotationDomain=dom_15,
    J4RotationDomain=dom_16,
    J5RotationDomain=dom_17,
    J6RotationDomain=dom_18,
    J1MaximumSpeed=250,
    J2MaximumSpeed=250,
    J3MaximumSpeed=250,
    J4MaximumSpeed=320,
    J5MaximumSpeed=320,
    J6MaximumSpeed=420)  # -> RotationDomains, MaximumJointSpeeds
panel_17 = Panel("""ABB 6650
125/3.2""")
robot_creator_3 = RobotCreator(
    NameS="MyRob",
    RobotBrand=panel_17,
    ControllerTechnology="IRC5",
    ModelPlane=PlaneXY(0, 0, 0),
    InstancePlaneS=graft(merge_2),
    BaseMeshes=base_mesh_3,
    J1Meshes=j1_mesh_3,
    J2Meshes=j2_mesh_3,
    J3Meshes=j3_mesh_3,
    J4Meshes=j4_mesh_3,
    J5Meshes=j5_mesh_3,
    J6Meshes=j6_mesh_3,
    IntersectionPointJ1J2=ptj1_j2_3,
    IntersectionPointJ2J3=ptj2_j3_3,
    WristPoint=wristpt_3,
    J6FlangeOrigin=j6forigin_3,
    RotationDomains=robaxisconf_3.RotationDomains,
    Payload=payload_3)  # -> graft(RobotDeclaration)

# ----
# Belt Sander Holder
number_slider_2 = Slider(56, range=0..1000)
pt_19 = Point(<point referenced from the Rhino model>)
cluster_9 = Cluster_6(G=pt_19, F=number_slider_2, G_3=pt_19, G_2=pt_19, F_2=number_slider_2, x=number_slider_2)  # -> V, E, y, V_2

# ----
# Belt Sander Holder
number_slider_3 = Slider(69, range=0..1000)
pt_20 = Point(<point referenced from the Rhino model>)
cluster_10 = Cluster_6(G=pt_20, F=number_slider_3, G_3=pt_20, G_2=pt_20, F_2=number_slider_3, x=number_slider_3)  # -> V, E, y, V_2

# ----
# Tool Length "OffSet"
tool_length_from_z_axis_of_joint_6_3 = Slider(18.5, range=10..48)
new_offset_3 = Slider(0, range=0..5)
subtraction_3 = Subtraction(A=tool_length_from_z_axis_of_joint_6_3, B=new_offset_3)
panel_18 = Panel(subtraction_3)

# ----
# Tool Length "OffSet"
tool_length_from_z_axis_of_joint_6_4 = Slider(17.75, range=10..48)
new_offset_4 = Slider(0, range=0..5)
subtraction_4 = Subtraction(A=tool_length_from_z_axis_of_joint_6_4, B=new_offset_4)
panel_19 = Panel(subtraction_4)

crv_9 = Curve(<curve referenced from the Rhino model>)
srf_7 = Surface(<surface referenced from the Rhino model>)
crv_10 = Curve(<curve referenced from the Rhino model>)
top_3 = PythonScript(leftLine=crv_10, rightLine=crv_9, lineCount=num, pointCount=num_2, surfaceZone=srf_7)  # -> out, projectedPoints; inputs leftLine: Curve, rightLine: Curve, lineCount: Int32; same code as top
pt_21 = Point(top_3.projectedPoints)

srf_8 = Surface(<surface referenced from the Rhino model>)
crv_11 = Curve(<curve referenced from the Rhino model>)
crv_12 = Curve(<curve referenced from the Rhino model>)
bottom_3 = PythonScript(leftLine=crv_11, rightLine=crv_12, lineCount=num, pointCount=num_2, surfaceZone=srf_8)  # -> out, projectedPoints; inputs leftLine: Curve, rightLine: Curve, lineCount: Int32; same code as top
pt_22 = Point(bottom_3.projectedPoints)

# ----
# Tool Extension
tool_offset_adjustment_plate_depth_3 = Slider(0, range=0..1)
tool_extension_3 = Slider(0, range=0..100)
addition_21 = Addition(A=tool_extension_3, B=tool_offset_adjustment_plate_depth_3)

# ----
# Tool Extension
tool_offset_adjustment_plate_depth_4 = Slider(0, range=0..1)
tool_extension_4 = Slider(0, range=0..100)
addition_22 = Addition(A=tool_extension_4, B=tool_offset_adjustment_plate_depth_4)

crv_13 = Curve(<curve referenced from the Rhino model>)
crv_14 = Curve(<curve referenced from the Rhino model>)
srf_9 = Surface(<surface referenced from the Rhino model>)
top_4 = PythonScript(leftLine=crv_13, rightLine=crv_14, lineCount=num, pointCount=num_2, surfaceZone=srf_9)  # -> out, projectedPoints; inputs leftLine: Curve, rightLine: Curve, lineCount: Int32; same code as top
pt_23 = Point(top_4.projectedPoints)

crv_15 = Curve(<curve referenced from the Rhino model>)
srf_10 = Surface(<surface referenced from the Rhino model>)
crv_16 = Curve(<curve referenced from the Rhino model>)
bottom_4 = PythonScript(leftLine=crv_16, rightLine=crv_15, lineCount=num, pointCount=num_2, surfaceZone=srf_10)  # -> out, projectedPoints; inputs leftLine: Curve, rightLine: Curve, lineCount: Int32; same code as top
pt_24 = Point(bottom_4.projectedPoints)

# ----
# Total Tool Length
fixed_sander_tool_offset_inches_3 = Slider(10, range=0..48)
addition_23 = Addition(A=addition_21, B=fixed_sander_tool_offset_inches_3)
panel_20 = Panel(addition_23)

# ----
# Total Tool Length
fixed_sander_tool_offset_inches_4 = Slider(10.5, range=0..48)
addition_24 = Addition(A=addition_22, B=fixed_sander_tool_offset_inches_4)
panel_21 = Panel(addition_24)

# ----
# Angle of Tool
cluster_11 = Cluster_7(
    A=_0_degrees_4,
    B=other_8,
    A_2=_0_degrees_4,
    B_2=other_7,
    A_3=_0_degrees_4,
    B_3=_180_degrees_4,
    G=list_16,
    _0=_0_degrees_4)

# ----
# Angle of Tool
cluster_12 = Cluster_3(
    A=_0_degrees_2,
    B=other_4,
    A_2=_0_degrees_2,
    B_2=other_3,
    A_3=_0_degrees_2,
    B_3=_180_degrees_2,
    G=list_8,
    _0=_0_degrees_2)

# ----
# Belt Sander Holder
number_slider_4 = Slider(56, range=0..1000)
pt_25 = Point(<point referenced from the Rhino model>)
cluster_13 = Cluster_6(G=pt_25, F=number_slider_4, G_3=pt_25, G_2=pt_25, F_2=number_slider_4, x=number_slider_4)  # -> V, E, y, V_2

# ----
# Belt Sander Holder
number_slider_5 = Slider(56, range=0..1000)
pt_26 = Point(<point referenced from the Rhino model>)
cluster_14 = Cluster_6(G=pt_26, F=number_slider_5, G_3=pt_26, G_2=pt_26, F_2=number_slider_5, x=number_slider_5)  # -> V, E, y, V_2

dam_2 = DataDam(BufferDelay=10000000, BufferMode=0)

# ----
# Angle of Tool
cluster_15 = Cluster_7(
    A=_0_degrees_3,
    B=other_6,
    A_2=_0_degrees_3,
    B_2=other_5,
    A_3=_0_degrees_3,
    B_3=_180_degrees_3,
    G=list_15,
    _0=_0_degrees_3)

# ----
# Angle of Tool
cluster_16 = Cluster_7(A=_0_degrees, B=other_2, A_2=_0_degrees, B_2=other, A_3=_0_degrees, B_3=_180_degrees, G=list_6, _0=_0_degrees)

# ----
# Path Points
filter_2 = StreamFilter(Gate=list, Stream0=low_point_count, Stream1=high_point_count)

# ----
# Path Points
filter_3 = StreamFilter(Gate=list, Stream0=low_point_count, Stream1=high_point_count)

# ----
# Path Points
filter_4 = StreamFilter(Gate=list, Stream0=low_point_count, Stream1=high_point_count)

# ----
# Path Points
filter_5 = StreamFilter(Gate=list, Stream0=low_point_count, Stream1=high_point_count)

cluster_17 = Cluster_14(
    G=moved_up_down_center_of_zone.Geometry,
    A=moved_up_down_center_of_zone.Geometry,
    D=angle_of_projection,
    x=move_left_right,
    V=cluster.V)  # -> L, R, V_2

# ----
# Rotate Around
# Center of Zone
move_offset_for_rotating = Move(Geometry=moved_up_down_center_of_zone.Geometry, Motion=cluster_17.V_2)  # -> Geometry, Transform
rotax_center_point_offset_for_vector = RotateAxis(Geometry=move_offset_for_rotating.Geometry, Angle=cluster_17.R, Axis=cluster_17.L)  # -> Geometry, Transform

cluster_18 = Cluster_9(A_2=addition_8, A=moved_up_down_center_of_zone.Geometry, B=rotax_center_point_offset_for_vector.Geometry, x=addition_2)  # -> V, V_2

# ----
# Edge Limits
moved_right_edge_center = Move(Geometry=moved_up_down_center_of_zone.Geometry, Motion=cluster_18.V_2)  # -> Geometry, Transform
moved_left_edge_center = Move(Geometry=moved_up_down_center_of_zone.Geometry, Motion=cluster_18.V)  # -> Geometry, Transform

# ----
# Edge Heights
cluster_19 = Cluster_11(
    F_2=addition_6,
    pt=moved_left_edge_center.Geometry,
    F=addition_4,
    G=moved_right_edge_center.Geometry,
    G_3=moved_right_edge_center.Geometry)  # -> G_2, G_4, G_5, G_6

# ----
# L. and R. Edges
ln_left_edge = Line(StartPoint=cluster_19.G_2, EndPoint=cluster_19.G_4)
ln_right_edge = Line(StartPoint=cluster_19.G_5, EndPoint=cluster_19.G_6)

cluster_20 = Cluster_13(C_2=ln_left_edge, left_line=ln_left_edge, right_line=ln_right_edge, C=ln_right_edge)  # -> L_3, L, left_line_3, right_line_3, L_4, L_2
merge_3 = Merge(
    Data1=cluster_20.L,
    Data2=cluster_20.left_line_3,
    Data3=cluster_20.right_line_3,
    Data4=cluster_20.L_2,
    Data5=cluster_20.L_3,
    Data6=cluster_20.L_4)

# ----
# Path
cluster_21 = Cluster_12(C_2=ln_left_edge, N=line_count, C=ln_right_edge, A=line_count)

join = JoinCurves(Curves=cluster_21, Preserve=False)
divide = DivideCurve(Curve=join, Count=filter_2, Kinks=False)  # -> Points, Tangents, Parameters

# ----
# Projection
project = ProjectPoint(Point=divide.Points, Direction=cluster_5, Geometry=brep_surface_for_orienting_tool)  # -> Point, Index

projected_curve_edges = Project(Curve=merge_3, Brep=brep_surface_for_orienting_tool, Direction=cluster_5)

# ----
# Robot 3
filter_6 = StreamFilter(Gate=list_7, Stream0=srf_9, Stream1=srf_10)
filter_7 = StreamFilter(Gate=list_7, Stream0=pt_23, Stream1=pt_24, Stream2=project.Point)

cluster_22 = Cluster_14(
    G=moved_up_down_center_of_zone_2.Geometry,
    A=moved_up_down_center_of_zone_2.Geometry,
    D=angle_of_projection,
    x=move_left_right,
    V=cluster_2.V)  # -> L, R, V_2

# ----
# Rotate Around
# Center of Zone
move_offset_for_rotating_2 = Move(Geometry=moved_up_down_center_of_zone_2.Geometry, Motion=cluster_22.V_2)  # -> Geometry, Transform
rotax_center_point_offset_for_vector_2 = RotateAxis(Geometry=move_offset_for_rotating_2.Geometry, Angle=cluster_22.R, Axis=cluster_22.L)  # -> Geometry, Transform

cluster_23 = Cluster_9(
    A_2=right_edge,
    A=moved_up_down_center_of_zone_2.Geometry,
    B=rotax_center_point_offset_for_vector_2.Geometry,
    x=left_edge)  # -> V, V_2

# ----
# Edge Limits
moved_right_edge_center_2 = Move(Geometry=moved_up_down_center_of_zone_2.Geometry, Motion=cluster_23.V_2)  # -> Geometry, Transform
moved_left_edge_center_2 = Move(Geometry=moved_up_down_center_of_zone_2.Geometry, Motion=cluster_23.V)  # -> Geometry, Transform

# ----
# Edge Heights
cluster_24 = Cluster_11(
    F_2=top_edge,
    pt=moved_left_edge_center_2.Geometry,
    F=bottom_edge,
    G=moved_right_edge_center_2.Geometry,
    G_3=moved_right_edge_center_2.Geometry)  # -> G_2, G_4, G_5, G_6

# ----
# L. and R. Edges
ln_left_edge_2 = Line(StartPoint=cluster_24.G_2, EndPoint=cluster_24.G_4)
ln_right_edge_2 = Line(StartPoint=cluster_24.G_5, EndPoint=cluster_24.G_6)

cluster_25 = Cluster_13(C_2=ln_left_edge_2, left_line=ln_left_edge_2, right_line=ln_right_edge_2, C=ln_right_edge_2)  # -> L_3, L, left_line_3, right_line_3, L_4, L_2
merge_4 = Merge(
    Data1=cluster_25.L,
    Data2=cluster_25.left_line_3,
    Data3=cluster_25.right_line_3,
    Data4=cluster_25.L_2,
    Data5=cluster_25.L_3,
    Data6=cluster_25.L_4)

# ----
# Path
cluster_26 = Cluster_12(C_2=ln_left_edge_2, N=line_count, C=ln_right_edge_2, A=line_count)

join_2 = JoinCurves(Curves=cluster_26, Preserve=False)
divide_2 = DivideCurve(Curve=join_2, Count=filter_3, Kinks=False)  # -> Points, Tangents, Parameters

# ----
# Projection
project_2 = ProjectPoint(Point=divide_2.Points, Direction=cluster_6, Geometry=brep_surface_for_orienting_tool)  # -> Point, Index

projected_curve_edges_2 = Project(Curve=merge_4, Brep=brep_surface_for_orienting_tool, Direction=cluster_6)

# ----
# Robot 4
filter_8 = StreamFilter(Gate=list_14, Stream0=pt_21, Stream1=pt_22, Stream2=project_2.Point)
filter_9 = StreamFilter(Gate=list_14, Stream0=srf_7, Stream1=srf_8)

cluster_27 = Cluster_14(
    G=moved_up_down_center_of_zone_3.Geometry,
    A=moved_up_down_center_of_zone_3.Geometry,
    D=angle_of_projection,
    x=move_left_right,
    V=cluster_3.V)  # -> L, R, V_2

# ----
# Rotate Around
# Center of Zone
move_offset_for_rotating_3 = Move(Geometry=moved_up_down_center_of_zone_3.Geometry, Motion=cluster_27.V_2)  # -> Geometry, Transform
rotax_center_point_offset_for_vector_3 = RotateAxis(Geometry=move_offset_for_rotating_3.Geometry, Angle=cluster_27.R, Axis=cluster_27.L)  # -> Geometry, Transform

cluster_28 = Cluster_9(
    A_2=right_edge,
    A=moved_up_down_center_of_zone_3.Geometry,
    B=rotax_center_point_offset_for_vector_3.Geometry,
    x=left_edge)  # -> V, V_2

# ----
# Edge Limits
moved_right_edge_center_3 = Move(Geometry=moved_up_down_center_of_zone_3.Geometry, Motion=cluster_28.V_2)  # -> Geometry, Transform
moved_left_edge_center_3 = Move(Geometry=moved_up_down_center_of_zone_3.Geometry, Motion=cluster_28.V)  # -> Geometry, Transform

# ----
# Edge Heights
cluster_29 = Cluster_11(
    F_2=top_edge,
    pt=moved_left_edge_center_3.Geometry,
    F=bottom_edge,
    G=moved_right_edge_center_3.Geometry,
    G_3=moved_right_edge_center_3.Geometry)  # -> G_2, G_4, G_5, G_6

# ----
# L. and R. Edges
ln_left_edge_3 = Line(StartPoint=cluster_29.G_2, EndPoint=cluster_29.G_4)
ln_right_edge_3 = Line(StartPoint=cluster_29.G_5, EndPoint=cluster_29.G_6)

cluster_30 = Cluster_13(C_2=ln_left_edge_3, left_line=ln_left_edge_3, right_line=ln_right_edge_3, C=ln_right_edge_3)  # -> L_3, L, left_line_3, right_line_3, L_4, L_2
merge_5 = Merge(
    Data1=cluster_30.L,
    Data2=cluster_30.left_line_3,
    Data3=cluster_30.right_line_3,
    Data4=cluster_30.L_2,
    Data5=cluster_30.L_3,
    Data6=cluster_30.L_4)

# ----
# Path
cluster_31 = Cluster_12(C_2=ln_left_edge_3, N=line_count, C=ln_right_edge_3, A=line_count)

join_3 = JoinCurves(Curves=cluster_31, Preserve=False)
divide_3 = DivideCurve(Curve=join_3, Count=filter_4, Kinks=False)  # -> Points, Tangents, Parameters

# ----
# Projection
project_3 = ProjectPoint(Point=divide_3.Points, Direction=cluster_7, Geometry=brep_surface_for_orienting_tool)  # -> Point, Index

projected_curve_edges_3 = Project(Curve=merge_5, Brep=brep_surface_for_orienting_tool, Direction=cluster_7)

# ----
# Robot 2
filter_10 = StreamFilter(Gate=list_17, Stream0=pt, Stream1=pt_2, Stream2=project_3.Point)
filter_11 = StreamFilter(Gate=list_17, Stream0=srf_3, Stream1=srf_4)

cluster_32 = Cluster_14(
    G=moved_up_down_center_of_zone_4.Geometry,
    A=moved_up_down_center_of_zone_4.Geometry,
    D=angle_of_projection,
    x=move_left_right,
    V=cluster_4.V)  # -> L, R, V_2

# ----
# Rotate Around
# Center of Zone
move_offset_for_rotating_4 = Move(Geometry=moved_up_down_center_of_zone_4.Geometry, Motion=cluster_32.V_2)  # -> Geometry, Transform
rotax_center_point_offset_for_vector_4 = RotateAxis(Geometry=move_offset_for_rotating_4.Geometry, Angle=cluster_32.R, Axis=cluster_32.L)  # -> Geometry, Transform

cluster_33 = Cluster_9(
    A_2=right_edge,
    A=moved_up_down_center_of_zone_4.Geometry,
    B=rotax_center_point_offset_for_vector_4.Geometry,
    x=left_edge)  # -> V, V_2

# ----
# Edge Limits
moved_right_edge_center_4 = Move(Geometry=moved_up_down_center_of_zone_4.Geometry, Motion=cluster_33.V_2)  # -> Geometry, Transform
moved_left_edge_center_4 = Move(Geometry=moved_up_down_center_of_zone_4.Geometry, Motion=cluster_33.V)  # -> Geometry, Transform

# ----
# Edge Heights
cluster_34 = Cluster_11(
    F_2=top_edge,
    pt=moved_left_edge_center_4.Geometry,
    F=bottom_edge,
    G=moved_right_edge_center_4.Geometry,
    G_3=moved_right_edge_center_4.Geometry)  # -> G_2, G_4, G_5, G_6

# ----
# L. and R. Edges
ln_left_edge_4 = Line(StartPoint=cluster_34.G_2, EndPoint=cluster_34.G_4)
ln_right_edge_4 = Line(StartPoint=cluster_34.G_5, EndPoint=cluster_34.G_6)

cluster_35 = Cluster_13(C_2=ln_left_edge_4, left_line=ln_left_edge_4, right_line=ln_right_edge_4, C=ln_right_edge_4)  # -> L_3, L, left_line_3, right_line_3, L_4, L_2
merge_6 = Merge(
    Data1=cluster_35.L,
    Data2=cluster_35.left_line_3,
    Data3=cluster_35.right_line_3,
    Data4=cluster_35.L_2,
    Data5=cluster_35.L_3,
    Data6=cluster_35.L_4)

# ----
# Path
cluster_36 = Cluster_12(C_2=ln_left_edge_4, N=line_count, C=ln_right_edge_4, A=line_count)

join_4 = JoinCurves(Curves=cluster_36, Preserve=False)
divide_4 = DivideCurve(Curve=join_4, Count=filter_5, Kinks=False)  # -> Points, Tangents, Parameters

# ----
# Projection
project_4 = ProjectPoint(Point=divide_4.Points, Direction=cluster_8, Geometry=brep_surface_for_orienting_tool)  # -> Point, Index

projected_curve_edges_4 = Project(Curve=merge_6, Brep=brep_surface_for_orienting_tool, Direction=cluster_8)

# ----
# Robot 1
filter_path = StreamFilter(Gate=list_9, Stream0=pt_6, Stream1=pt_7)
filter_12 = StreamFilter(Gate=list_9, Stream0=srf_5, Stream1=srf_6, Stream2=project_4.Point)

# ----
# Path Targets
plane_to_hopefully_set_rotation_of_tool = Plane(Plane(origin=(5603.620095, -5566.124742, -543.302059), x=(-0.3201395074, 0.9473704111, -6.064259164e-07), y=(0.629070833, 0.2125788157, 0.7477166135)))
targetorient = TargetOrientation(
    Method=Slider(4, range=0..10),
    Waypoints=filter_10,
    InstancePlane=plane_to_hopefully_set_rotation_of_tool,
    GuideBrep=brep)
remapping = Cluster(L=targetorient, V=remapped_path_4)
filter_13 = StreamFilter(Gate=list_13, Stream0=remapping, Stream1=addition_16)
item = ListItem(List=targetorient, Index=filter_13, Wrap=True)
filter_14 = StreamFilter(Gate=list_12, Stream0=targetorient, Stream1=item)

# ----
# Path Targets
plane_to_hopefully_set_rotation_of_tool_2 = Plane(Plane(origin=(5603.620095, -5566.124742, -543.302059), x=(-0.3201395074, 0.9473704111, -6.064259164e-07), y=(0.629070833, 0.2125788157, 0.7477166135)))
targetorient_2 = TargetOrientation(
    Method=Slider(2, range=0..10),
    Waypoints=filter_path,
    InstancePlane=plane_to_hopefully_set_rotation_of_tool_2,
    GuideBrep=brep)
cluster_37 = Cluster(L=targetorient_2, V=remapped_path_2)
filter_15 = StreamFilter(Gate=list_5, Stream0=cluster_37, Stream1=addition_12, Stream2=counter)
item_2 = ListItem(List=targetorient_2, Index=filter_15, Wrap=True)
filter_16 = StreamFilter(Gate=list_4, Stream0=targetorient_2, Stream1=item_2)

# ----
# Calc. Tool Angle
number_slider_6 = Slider(1, range=0..1)
galapagos = Galapagos(fitness=num_3, gene=other_6)

# ----
# Tool Definition
multiplication_9 = Multiplication(A=addition_17, B=25.4)
vec = VectorXYZ(XComponent=0, YComponent=0, ZComponent=multiplication_9)  # -> Vector, Length
pt_27 = Point(<point referenced from the Rhino model>)
cluster_38 = Cluster_4(A=fixed_sander_tool_offset_inches_2, G=pt_27, A_2=subtraction, G_2=pt_27, G_3=pt_27)  # -> R, pt_6, pt_4, pt_5
move_4 = Move(Geometry=pt_27, Motion=vec.Vector)  # -> Geometry, Transform
planesrf = PlaneSurface(Plane=move_4.Geometry, XSize=Domain(-10, 10), YSize=Domain(-10, 10))
mass = Mass(40)

# ----
# Rotation of TCP
cluster_39 = Cluster_2(G=cluster_38.pt_6, A=cluster_38.pt_6, G_3=cluster_38.pt_5, D=cluster_11, G_2=cluster_38.pt_4)  # -> G_5, G_4

# ----
# Tool Definition
multiplication_10 = Multiplication(A=addition_18, B=25.4)
vec_2 = VectorXYZ(XComponent=0, YComponent=0, ZComponent=multiplication_10)  # -> Vector, Length
pt_28 = Point(<point referenced from the Rhino model>)
cluster_40 = Cluster_4(A=fixed_sander_tool_offset_inches, G=pt_28, A_2=subtraction_2, G_2=pt_28, G_3=pt_28)  # -> R, pt_6, pt_4, pt_5
move_5 = Move(Geometry=pt_28, Motion=vec_2.Vector)  # -> Geometry, Transform
# Tool
panel_22 = Panel("Tool")
planesrf_2 = PlaneSurface(Plane=move_5.Geometry, XSize=Domain(-10, 10), YSize=Domain(-10, 10))
mass_2 = Mass(40)

# ----
# Rotation of TCP
cluster_41 = Cluster_2(G=cluster_40.pt_6, A=cluster_40.pt_6, G_3=cluster_40.pt_5, D=cluster_12, G_2=cluster_40.pt_4)  # -> G_5, G_4

# ----
# Analysis:
# Reach and
# Collision
# Detections
list_18 = ValueList({"Collisions Between Robot (etc) and Context": 0, "Collisions Between Robot (etc.) and Tooling": 1, "Collisions Between Robot Arm and Base": 2, "Collisions Between Objects and Robot Arm and Tooling": 3, "Collisions Between Joints": 4}, selected="Collisions Between Objects and Robot Arm and Tooling")

# ----
# Tool Model
sbody = StaticBody([<static body referenced from the Rhino model> x12])
addition_25 = Addition(A=multiplication_9, B=cluster_38.R)

# ----
# Belt Sander
# Extension
cluster_42 = Cluster_5(
    pln=pt_19,
    G=pt_19,
    F=number_slider_2,
    T=cluster_9.V,
    R=number_slider_2,
    F_3=addition_25,
    G_2=pt_19,
    F_2=cluster_9.y,
    T_2=cluster_9.V_2)  # -> R_2, V
extr = Extrude(Base=cluster_42.R_2, Direction=cluster_42.V)

merge_7 = Merge(Data1=sbody, Data2=cluster_9.E, Data3=extr)

pl_3pt_5 = Plane3Pt(PointA=cluster_38.pt_6, PointB=cluster_39.G_4, PointC=cluster_39.G_5)
# Tool
tool = ToolPreset(
    Name="Tool",
    Number=16,
    FixationPlane=planesrf,
    ToolCenterPoint=pl_3pt_5,
    OnRobot=True,
    Mass=mass,
    StaticBody=merge_7,
    DeactivatedColor=RGBA(255, 165, 0, 200),
    ActivatedColor=RGBA(255, 0, 255, 200),
    ActivatedValue=True,
    DOChannelS="DO_12",
    Language="ABB RAPID")  # -> Tool, Code, FixationPlane, TCP, ToolGeometry

toolpath_creator = ToolpathCreator(Name="TP", Targets=filter_14, Tools=tool.Tool, FlipS=-1, RobID=0)

iksolver = InverseKinematicsSolver(
    RobotPreset=robot_creator,
    Toolpath=toolpath_creator,
    ComputeGeometry=list_12,
    KeepDO=True,
    ErrorDisabled=True,
    LargeReor=90)  # -> JointRotations, OrientedBase, OrientedJoints, OrientedTool, Log, EnvelopeCheck, PathsOut, TotalOut
panel_23 = Panel(iksolver.JointRotations)
merge_rbt_2 = Merge(Data1=iksolver.OrientedBase, Data2=iksolver.OrientedJoints, Data3=iksolver.OrientedTool)
merge_8 = Merge(Data1=merge, Data2=merge_rbt_2)
collisions_solver = CollisionsSolver(
    RobotBase=iksolver.OrientedBase,
    RobotArm=iksolver.OrientedJoints,
    Tool=iksolver.OrientedTool,
    Objects=merge_8,
    Method=list_18,
    BypassContext=False,
    BypassBase=False,
    BypassArm=False,
    BypassTool=False,
    BypassObj=False,
    BypassJ1=True,
    BypassJ4=True)  # -> TestedContext, TestedBase, TestedJoints, TestedJ456, TestedTool, TestedObjects, Log, Collisions
panel_24 = Panel(collisions_solver.Log)

# ----
# Analysis:
# Reach and
# Collision
# Detections
merge_9 = Merge(Data1=merge, Data2=merge_rbt_2)
list_19 = ValueList({"Collisions Between Robot (etc) and Context": 0, "Collisions Between Robot (etc.) and Tooling": 1, "Collisions Between Robot Arm and Base": 2, "Collisions Between Objects and Robot Arm and Tooling": 3, "Collisions Between Joints": 4}, selected="Collisions Between Objects and Robot Arm and Tooling")

# ----
# Tool Model
sbody_2 = StaticBody([<static body referenced from the Rhino model> x12])
addition_26 = Addition(A=multiplication_10, B=cluster_40.R)

# ----
# Belt Sander Extension
cluster_43 = Cluster_5(
    pln=pt_20,
    G=pt_20,
    F=number_slider_3,
    T=cluster_10.V,
    R=number_slider_3,
    F_3=addition_26,
    G_2=pt_20,
    F_2=cluster_10.y,
    T_2=cluster_10.V_2)  # -> R_2, V
extr_2 = Extrude(Base=cluster_43.R_2, Direction=cluster_43.V)

merge_10 = Merge(Data1=sbody_2, Data2=cluster_10.E, Data3=extr_2)

pl_3pt_6 = Plane3Pt(PointA=cluster_40.pt_6, PointB=cluster_41.G_4, PointC=cluster_41.G_5)
tool_2 = ToolPreset(
    Name=panel_22,
    Number=16,
    FixationPlane=planesrf_2,
    ToolCenterPoint=pl_3pt_6,
    OnRobot=True,
    Mass=mass_2,
    StaticBody=merge_10,
    DeactivatedColor=RGBA(255, 165, 0, 200),
    ActivatedColor=RGBA(255, 0, 255, 200),
    ActivatedValue=True,
    DOChannelS="DO_12",
    Language="ABB RAPID")  # -> Tool, Code, FixationPlane, TCP, ToolGeometry

toolpath_creator_2 = ToolpathCreator(Name="TP", Targets=filter_16, Tools=tool_2.Tool, FlipS=-1, RobID=0)

iksolver_2 = InverseKinematicsSolver(
    RobotPreset=robot_creator_2,
    Toolpath=toolpath_creator_2,
    ComputeGeometry=list_4,
    KeepDO=True,
    ErrorDisabled=True,
    LargeReor=90)  # -> JointRotations, OrientedBase, OrientedJoints, OrientedTool, Log, EnvelopeCheck, PathsOut, TotalOut
collisions_solver_2 = CollisionsSolver(
    RobotBase=iksolver_2.OrientedBase,
    RobotArm=iksolver_2.OrientedJoints,
    Tool=iksolver_2.OrientedTool,
    Objects=merge_9,
    Method=list_19,
    BypassContext=False,
    BypassBase=False,
    BypassArm=False,
    BypassTool=False,
    BypassObj=False,
    BypassJ1=True,
    BypassJ4=True)  # -> TestedContext, TestedBase, TestedJoints, TestedJ456, TestedTool, TestedObjects, Log, Collisions
panel_25 = Panel(iksolver_2.JointRotations)
merge_geo_of_rbt_1 = Merge(Data1=iksolver_2.OrientedBase, Data2=iksolver_2.OrientedJoints, Data3=iksolver_2.OrientedTool)

panel_26 = Panel(collisions_solver_2.Log)

# ----
# Robot #1 Path Targets
plane_to_hopefully_set_rotation_of_tool_3 = Plane(Plane(origin=(5603.620095, -5566.124742, -543.302059), x=(-0.3201395074, 0.9473704111, -6.064259164e-07), y=(0.629070833, 0.2125788157, 0.7477166135)))
targetorient_3 = TargetOrientation(
    Method=Slider(4, range=0..10),
    Waypoints=filter_8,
    InstancePlane=plane_to_hopefully_set_rotation_of_tool_3,
    GuideBrep=brep)
cluster_44 = Cluster(L=targetorient_3, V=remapped_path_3)
filter_17 = StreamFilter(Gate=list_11, Stream0=cluster_44, Stream1=addition_14)
item_3 = ListItem(List=targetorient_3, Index=filter_17, Wrap=True)
filter_18 = StreamFilter(Gate=list_10, Stream0=targetorient_3, Stream1=item_3)

# ----
# Robot #3 Path Targets
plane_to_hopefully_set_rotation_of_tool_4 = Plane(Plane(origin=(5603.620095, -5566.124742, -543.302059), x=(-0.3201395074, 0.9473704111, -6.064259164e-07), y=(0.629070833, 0.2125788157, 0.7477166135)))
remapped_path_5 = Slider(1, range=0..1)
target_no_5 = Slider(186, range=0..1500)
list_20 = ValueList({"Remapped": 0, "Target Value": 1}, selected="Target Value")
targetorient_4 = TargetOrientation(
    Method=Slider(4, range=0..10),
    Waypoints=filter_7,
    InstancePlane=plane_to_hopefully_set_rotation_of_tool_4,
    GuideBrep=brep)
cluster_45 = Cluster(L=targetorient_4, V=remapped_path)
filter_19 = StreamFilter(Gate=list_3, Stream0=cluster_45, Stream1=addition_10)
item_4 = ListItem(List=targetorient_4, Index=filter_19, Wrap=True)
filter_20 = StreamFilter(Gate=list_2, Stream0=targetorient_4, Stream1=item_4)

# ----
# Tool Definition
multiplication_11 = Multiplication(A=addition_21, B=25.4)
vec_3 = VectorXYZ(XComponent=0, YComponent=0, ZComponent=multiplication_11)  # -> Vector, Length
pt_29 = Point(<point referenced from the Rhino model>)
cluster_46 = Cluster_4(A=fixed_sander_tool_offset_inches_3, G=pt_29, A_2=subtraction_3, G_2=pt_29, G_3=pt_29)  # -> R, pt_6, pt_4, pt_5
move_6 = Move(Geometry=pt_29, Motion=vec_3.Vector)  # -> Geometry, Transform
planesrf_3 = PlaneSurface(Plane=move_6.Geometry, XSize=Domain(-10, 10), YSize=Domain(-10, 10))
mass_3 = Mass(40)

# ----
# Rotation of TCP
cluster_47 = Cluster_2(G=cluster_46.pt_6, A=cluster_46.pt_6, G_3=cluster_46.pt_5, D=cluster_15, G_2=cluster_46.pt_4)  # -> G_5, G_4

# ----
# Tool Definition
multiplication_12 = Multiplication(A=addition_22, B=25.4)
vec_4 = VectorXYZ(XComponent=0, YComponent=0, ZComponent=multiplication_12)  # -> Vector, Length
pt_30 = Point(<point referenced from the Rhino model>)
cluster_48 = Cluster_4(A=fixed_sander_tool_offset_inches_4, G=pt_30, A_2=subtraction_4, G_2=pt_30, G_3=pt_30)  # -> R, pt_6, pt_4, pt_5
move_7 = Move(Geometry=pt_30, Motion=vec_4.Vector)  # -> Geometry, Transform
planesrf_4 = PlaneSurface(Plane=move_7.Geometry, XSize=Domain(-10, 10), YSize=Domain(-10, 10))
mass_4 = Mass(40)

# ----
# Rotation of TCP
cluster_49 = Cluster_2(G=cluster_48.pt_6, A=cluster_48.pt_6, G_3=cluster_48.pt_5, D=cluster_16, G_2=cluster_48.pt_4)  # -> G_5, G_4

# ----
# Tool Model
sbody_3 = StaticBody([<static body referenced from the Rhino model> x12])
addition_27 = Addition(A=multiplication_12, B=cluster_48.R)

# ----
# Belt Sander
# Extension
cluster_50 = Cluster_5(
    pln=pt_25,
    G=pt_25,
    F=number_slider_4,
    T=cluster_13.V,
    R=number_slider_4,
    F_3=addition_27,
    G_2=pt_25,
    F_2=cluster_13.y,
    T_2=cluster_13.V_2)  # -> R_2, V
extr_3 = Extrude(Base=cluster_50.R_2, Direction=cluster_50.V)

merge_11 = Merge(Data1=sbody_3, Data2=cluster_13.E, Data3=extr_3)

pl_3pt_7 = Plane3Pt(PointA=cluster_48.pt_6, PointB=cluster_49.G_4, PointC=cluster_49.G_5)
# Tool
tool_3 = ToolPreset(
    Name="Tool",
    Number=16,
    FixationPlane=planesrf_4,
    ToolCenterPoint=pl_3pt_7,
    OnRobot=True,
    Mass=mass_4,
    StaticBody=merge_11,
    DeactivatedColor=RGBA(255, 165, 0, 200),
    ActivatedColor=RGBA(255, 0, 255, 200),
    ActivatedValue=True,
    DOChannelS="DO_12",
    Language="ABB RAPID")  # -> Tool, Code, FixationPlane, TCP, ToolGeometry

toolpath_creator_3 = ToolpathCreator(Name="TP", Targets=filter_20, Tools=tool_3.Tool, FlipS=-1, RobID=0)

# ----
# Analysis:
# Reach and
# Collision
# Detections
flatten = FlattenTree(Tree=robot_creator_3, Path="{0}")
list_21 = ValueList({"Collisions Between Robot (etc) and Context": 0, "Collisions Between Robot (etc.) and Tooling": 1, "Collisions Between Robot Arm and Base": 2, "Collisions Between Objects and Robot Arm and Tooling": 3, "Collisions Between Joints": 4}, selected="Collisions Between Objects and Robot Arm and Tooling")
item_5 = ListItem(List=flatten, Index=0, Wrap=True)
iksolver_3 = InverseKinematicsSolver(RobotPreset=item_5, Toolpath=toolpath_creator_3, ComputeGeometry=list_2, KeepDO=True, ErrorDisabled=True, LargeReor=90)  # -> JointRotations, OrientedBase, OrientedJoints, OrientedTool, Log, EnvelopeCheck, PathsOut, TotalOut
panel_27 = Panel(iksolver_3.JointRotations)
merge_rbt_2_2 = Merge(Data1=iksolver_3.OrientedBase, Data2=iksolver_3.OrientedJoints, Data3=iksolver_3.OrientedTool)
merge_12 = Merge(Data1=merge, Data2=merge_rbt_2_2)
collisions_solver_3 = CollisionsSolver(
    RobotBase=iksolver_3.OrientedBase,
    RobotArm=iksolver_3.OrientedJoints,
    Tool=iksolver_3.OrientedTool,
    Objects=merge_12,
    Method=list_21,
    BypassContext=False,
    BypassBase=False,
    BypassArm=False,
    BypassTool=False,
    BypassObj=False,
    BypassJ1=True,
    BypassJ4=True)  # -> TestedContext, TestedBase, TestedJoints, TestedJ456, TestedTool, TestedObjects, Log, Collisions
panel_28 = Panel(collisions_solver_3.Log)

pl_3pt_8 = Plane3Pt(PointA=cluster_46.pt_6, PointB=cluster_47.G_4, PointC=cluster_47.G_5)

# ----
# Tool Model
sbody_4 = StaticBody([<static body referenced from the Rhino model> x12])
addition_28 = Addition(A=multiplication_11, B=cluster_46.R)

# ----
# Belt Sander
# Extension
cluster_51 = Cluster_5(
    pln=pt_26,
    G=pt_26,
    F=number_slider_5,
    T=cluster_14.V,
    R=number_slider_5,
    F_3=addition_28,
    G_2=pt_26,
    F_2=cluster_14.y,
    T_2=cluster_14.V_2)  # -> R_2, V
extr_4 = Extrude(Base=cluster_51.R_2, Direction=cluster_51.V)

merge_13 = Merge(Data1=sbody_4, Data2=cluster_14.E, Data3=extr_4)

# ----
# Tool
tool_4 = ToolPreset(
    Name="Tool",
    Number=16,
    FixationPlane=planesrf_3,
    ToolCenterPoint=pl_3pt_8,
    OnRobot=True,
    Mass=mass_3,
    StaticBody=merge_13,
    DeactivatedColor=RGBA(255, 165, 0, 200),
    ActivatedColor=RGBA(255, 0, 255, 200),
    ActivatedValue=True,
    DOChannelS="DO_12",
    Language="ABB RAPID")  # -> Tool, Code, FixationPlane, TCP, ToolGeometry

toolpath_creator_4 = ToolpathCreator(Name="TP", Targets=filter_18, Tools=tool_4.Tool, FlipS=-1, RobID=0)

# ----
# Analysis:
# Reach and
# Collision
# Detections
list_22 = ValueList({"Collisions Between Robot (etc) and Context": 0, "Collisions Between Robot (etc.) and Tooling": 1, "Collisions Between Robot Arm and Base": 2, "Collisions Between Objects and Robot Arm and Tooling": 3, "Collisions Between Joints": 4}, selected="Collisions Between Objects and Robot Arm and Tooling")
flatten_2 = FlattenTree(Tree=flatten, Path="{0}")
item_6 = ListItem(List=flatten_2, Index=1, Wrap=True)
iksolver_4 = InverseKinematicsSolver(RobotPreset=item_6, Toolpath=toolpath_creator_4, ComputeGeometry=list_10, KeepDO=True, ErrorDisabled=True, LargeReor=90)  # -> JointRotations, OrientedBase, OrientedJoints, OrientedTool, Log, EnvelopeCheck, PathsOut, TotalOut
panel_29 = Panel(iksolver_4.JointRotations)
merge_rbt_2_3 = Merge(Data1=iksolver_4.OrientedBase, Data2=iksolver_4.OrientedJoints, Data3=iksolver_4.OrientedTool)
merge_14 = Merge(Data1=merge, Data2=merge_rbt_2_3)
collisions_solver_4 = CollisionsSolver(
    RobotBase=iksolver_4.OrientedBase,
    RobotArm=iksolver_4.OrientedJoints,
    Tool=iksolver_4.OrientedTool,
    Objects=merge_14,
    Method=list_22,
    BypassContext=False,
    BypassBase=False,
    BypassArm=False,
    BypassTool=False,
    BypassObj=False,
    BypassJ1=True,
    BypassJ4=True)  # -> TestedContext, TestedBase, TestedJoints, TestedJ456, TestedTool, TestedObjects, Log, Collisions
panel_30 = Panel(collisions_solver_4.Log)

# ----
# Reach, Etc... Problems
flatten_3 = FlattenTree(Tree=iksolver_4.Log, Path="{0}")
lng_17 = ListLength(List=flatten_3)
panel_31 = Panel(lng_17)

addition_29 = Addition(A=panel_31, B=number_slider_6)
num_3 = Number(addition_29)
panel_32 = Panel(num_3)

# ==== cluster Cluster
L = ClusterInput()
lng = ListLength(List=L)
multiplication = Multiplication(A=L, B=lng)
subtraction = Subtraction(A=lng, B="\"1\"")
dom = ConstructDomain(DomainStart="\"0\"", DomainEnd=subtraction)
V = ClusterInput()
remap = RemapNumbers(Value=V, Source=Domain(0, 1), Target=dom)  # -> Mapped, Clipped
round = Round(Number=remap.Mapped)  # -> Nearest, Floor, Ceiling
N = ClusterOutput(round.Nearest)

# ==== cluster Cluster_2
D = ClusterInput()
rad = Radians(Degrees=D)
vec = VectorXYZ(XComponent=Slider(100, range=0..100), YComponent=0, ZComponent=0)  # -> Vector, Length
G = ClusterInput()
move = Move(Geometry=G, Motion=vec.Vector)  # -> Geometry, Transform
G_2 = ClusterInput()
G_3 = ClusterInput()
A = ClusterInput()
ln = Line(StartPoint=A, EndPoint=move.Geometry)
rotax = RotateAxis(Geometry=G_2, Angle=rad, Axis=ln)  # -> Geometry, Transform
rotax_2 = RotateAxis(Geometry=G_3, Angle=rad, Axis=ln)  # -> Geometry, Transform
G_4 = ClusterOutput(rotax.Geometry)
G_5 = ClusterOutput(rotax_2.Geometry)

# ==== cluster Cluster_3
A = ClusterInput()
B = ClusterInput()
A_2 = ClusterInput()
B_2 = ClusterInput()
A_3 = ClusterInput()
B_3 = ClusterInput()
G = ClusterInput()
_0 = ClusterInput()
addition = Addition(A=A, B=B)
addition_2 = Addition(A=A_2, B=B_2)
addition_3 = Addition(A=A_3, B=B_3)
filter = StreamFilter(Gate=G, Stream0=_0, Stream1=addition, Stream2=addition_3, Stream3=addition_2)
s_0 = ClusterOutput(filter)

# ==== cluster Cluster_4
A = ClusterInput()
A_2 = ClusterInput()
multiplication = Multiplication(A=A, B=25.4)
multiplication_2 = Multiplication(A=A_2, B=25.4)
neg = Negative(Value=multiplication)
R = ClusterOutput(multiplication)
addition = Addition(A=neg, B=100)
vec = VectorXYZ(XComponent=multiplication_2, YComponent=0, ZComponent=neg)  # -> Vector, Length
vec_2 = VectorXYZ(XComponent=multiplication_2, YComponent=0, ZComponent=addition)  # -> Vector, Length
vec_3 = VectorXYZ(XComponent=multiplication_2, YComponent=Slider(100, range=0..100), ZComponent=addition)  # -> Vector, Length
G = ClusterInput()
G_2 = ClusterInput()
G_3 = ClusterInput()
move = Move(Geometry=G, Motion=vec.Vector)  # -> Geometry, Transform
move_2 = Move(Geometry=G_2, Motion=vec_2.Vector)  # -> Geometry, Transform
move_3 = Move(Geometry=G_3, Motion=vec_3.Vector)  # -> Geometry, Transform
pt = Point(move_2.Geometry)
pt_2 = Point(move_3.Geometry)
pt_3 = Point(move.Geometry)
pt_4 = ClusterOutput(pt)
pt_5 = ClusterOutput(pt_2)
pt_6 = ClusterOutput(pt_3)

# ==== cluster Cluster_5
F = ClusterInput()
X = UnitX(Factor=F)
F_2 = ClusterInput()
G = ClusterInput()
X_2 = UnitX(Factor=F_2)
pln = ClusterInput()
move = Move(Geometry=G, Motion=X)  # -> Geometry, Transform
T = ClusterInput()
G_2 = ClusterInput()
pln_2 = Plane(pln)
move_2 = Move(Geometry=move.Geometry, Motion=T)  # -> Geometry, Transform
move_3 = Move(Geometry=G_2, Motion=X_2)  # -> Geometry, Transform
T_2 = ClusterInput()
R = ClusterInput()
move_4 = Move(Geometry=move_3.Geometry, Motion=T_2)  # -> Geometry, Transform
rec_2pt = Rectangle2Pt(Plane=pln_2, PointA=move_2.Geometry, PointB=move_4.Geometry, Radius=R)  # -> Rectangle, Length
R_2 = ClusterOutput(rec_2pt.Rectangle)
F_3 = ClusterInput()
Z = UnitZ(Factor=F_3)
V = ClusterOutput(Z)

# ==== cluster Cluster_6
x = ClusterInput()
F = ClusterInput()
F_2 = ClusterInput()
neg = Negative(Value=x)
Z = UnitZ(Factor=F)
G = ClusterInput()
Y = UnitY(Factor=F_2)
G_2 = ClusterInput()
y = ClusterOutput(neg)
move = Move(Geometry=G, Motion=Z)  # -> Geometry, Transform
V = ClusterOutput(Y)
Z_2 = UnitZ(Factor=neg)
move_2 = Move(Geometry=G_2, Motion=Z_2)  # -> Geometry, Transform
Y_2 = UnitY(Factor=neg)
V_2 = ClusterOutput(Y_2)
move_3 = Move(Geometry=move_2.Geometry, Motion=Y)  # -> Geometry, Transform
G_3 = ClusterInput()
move_4 = Move(Geometry=move.Geometry, Motion=Y)  # -> Geometry, Transform
move_5 = Move(Geometry=G_3, Motion=Y_2)  # -> Geometry, Transform
rec_3pt = Rectangle3Pt(PointA=move_4.Geometry, PointB=move_3.Geometry, PointC=move_5.Geometry)  # -> Rectangle, Length
X = UnitX(Factor=Slider(125, range=0..1000))
extr = Extrude(Base=rec_3pt.Rectangle, Direction=X)
E = ClusterOutput(extr)
move_6 = Move(Geometry=move_2.Geometry, Motion=Y_2)  # -> Geometry, Transform

# ==== cluster Cluster_7
A = ClusterInput()
B = ClusterInput()
A_2 = ClusterInput()
B_2 = ClusterInput()
A_3 = ClusterInput()
B_3 = ClusterInput()
G = ClusterInput()
_0 = ClusterInput()
addition = Addition(A=A, B=B)
addition_2 = Addition(A=A_2, B=B_2)
addition_3 = Addition(A=A_3, B=B_3)
filter = StreamFilter(Gate=G, Stream0=_0, Stream1=addition, Stream2=addition_3, Stream3=addition_2)
s_1 = ClusterOutput(filter)

# ==== cluster Cluster_8
A = ClusterInput()
B = ClusterInput()
A_2 = ClusterInput()
A_3 = ClusterInput()
G = ClusterInput()
G_2 = ClusterInput()

Z = UnitZ(Factor=1)
vec2pt = Vector2Pt(PointA=A, PointB=B, Unitize=False)  # -> Vector, Length
amp = Amplitude(Vector=vec2pt.Vector, Amplitude=A_2)
amp_2 = Amplitude(Vector=Z, Amplitude=A_3)
move = Move(Geometry=G, Motion=amp)  # -> Geometry, Transform
moved_left_right = Move(Geometry=G_2, Motion=amp)  # -> Geometry, Transform
move_2 = Move(Geometry=move.Geometry, Motion=amp_2)  # -> Geometry, Transform

V = ClusterOutput(vec2pt.Vector)
V_2 = ClusterOutput(amp_2)
G_3 = ClusterOutput(moved_left_right.Geometry)
G_4 = ClusterOutput(move_2.Geometry)

# ==== cluster Cluster_9
A = ClusterInput()
B = ClusterInput()
vec2pt = Vector2Pt(PointA=A, PointB=B, Unitize=False)  # -> Vector, Length
x = ClusterInput()
A_2 = ClusterInput()
neg = Negative(Value=x)
amp = Amplitude(Vector=vec2pt.Vector, Amplitude=A_2)
amp_2 = Amplitude(Vector=vec2pt.Vector, Amplitude=neg)
V = ClusterOutput(amp)
V_2 = ClusterOutput(amp_2)

# ==== cluster Cluster_10
D = ClusterInput()
rad = Radians(Degrees=D)
number_slider = Slider(100, range=0..100)
neg = Negative(Value=number_slider)
X = UnitX(Factor=neg)
Z = UnitZ(Factor=number_slider)
G = ClusterInput()
move = Move(Geometry=G, Motion=X)  # -> Geometry, Transform
G_2 = ClusterInput()
G_3 = ClusterInput()
move_2 = Move(Geometry=G_2, Motion=Z)  # -> Geometry, Transform
A = ClusterInput()
ln = Line(StartPoint=A, EndPoint=move_2.Geometry)
rotax = RotateAxis(Geometry=G_3, Angle=rad, Axis=ln)  # -> Geometry, Transform
rotax_2 = RotateAxis(Geometry=move.Geometry, Angle=rad, Axis=ln)  # -> Geometry, Transform
vec2pt = Vector2Pt(PointA=rotax_2.Geometry, PointB=rotax.Geometry, Unitize=False)  # -> Vector, Length
V = ClusterOutput(vec2pt.Vector)

# ==== cluster Cluster_11
pt = ClusterInput()
F = ClusterInput()
F_2 = ClusterInput()
pt_2 = Point(pt)
Z = UnitZ(Factor=F)
Z_2 = UnitZ(Factor=F_2)
neg = Negative(Value=Z)
move = Move(Geometry=pt_2, Motion=Z_2)  # -> Geometry, Transform
move_2 = Move(Geometry=pt_2, Motion=neg)  # -> Geometry, Transform
G = ClusterInput()
G_2 = ClusterOutput(move.Geometry)
G_3 = ClusterInput()
G_4 = ClusterOutput(move_2.Geometry)
move_3 = Move(Geometry=G, Motion=Z_2)  # -> Geometry, Transform
move_4 = Move(Geometry=G_3, Motion=neg)  # -> Geometry, Transform
G_5 = ClusterOutput(move_3.Geometry)
G_6 = ClusterOutput(move_4.Geometry)

# ==== cluster Cluster_12
A = ClusterInput()
subtraction = Subtraction(A=A, B="\"1\"")
C = ClusterInput()
C_2 = ClusterInput()
N = ClusterInput()
divide = DivideCurve(Curve=C, Count=subtraction, Kinks=False)  # -> Points, Tangents, Parameters
divide_2 = DivideCurve(Curve=C_2, Count=N, Kinks=False)  # -> Points, Tangents, Parameters
weave = Weave(Pattern=[0, 1], Stream0=divide_2.Points, Stream1=divide.Points, NullGaps=False)
shift = ShiftList(List=weave, Shift=1, Wrap=Toggle(False))
ln = Line(StartPoint=weave, EndPoint=shift)
L = ClusterOutput(ln)

# ==== cluster Cluster_13
C = ClusterInput()
C_2 = ClusterInput()
end = EndPoints(Curve=C)  # -> Start, End
end_2 = EndPoints(Curve=C_2)  # -> Start, End
right_line = ClusterInput()
left_line = ClusterInput()
right_line_2 = Curve(right_line)
top_line = Line(StartPoint=end_2.Start, EndPoint=end.Start)
left_line_2 = Curve(left_line)
bottom_line = Line(StartPoint=end_2.End, EndPoint=end.End)
L = ClusterOutput(top_line)
L_2 = ClusterOutput(bottom_line)
left_line_3 = ClusterOutput(left_line_2)
number_slider = Slider(2, range=0..10)
right_line_3 = ClusterOutput(right_line_2)
divide = DivideCurve(Curve=top_line, Count=number_slider, Kinks=False)  # -> Points, Tangents, Parameters
divide_2 = DivideCurve(Curve=left_line_2, Count=number_slider, Kinks=False)  # -> Points, Tangents, Parameters
divide_3 = DivideCurve(Curve=right_line_2, Count=number_slider, Kinks=False)  # -> Points, Tangents, Parameters
divide_4 = DivideCurve(Curve=bottom_line, Count=number_slider, Kinks=False)  # -> Points, Tangents, Parameters
number_slider_2 = Slider(1, range=0..1)
item = ListItem(List=divide.Points, Index=number_slider_2, Wrap=True)
item_2 = ListItem(List=divide_2.Points, Index=number_slider_2, Wrap=True)
item_3 = ListItem(List=divide_3.Points, Index=number_slider_2, Wrap=True)
item_4 = ListItem(List=divide_4.Points, Index=number_slider_2, Wrap=True)

ln = Line(StartPoint=item_2, EndPoint=item_3)
divide_5 = DivideCurve(Curve=ln, Count=number_slider, Kinks=False)  # -> Points, Tangents, Parameters
item_5 = ListItem(List=divide_5.Points, Index=Slider(1, range=0..1), Wrap=True)

ln_2 = Line(StartPoint=item, EndPoint=item_4)
divide_6 = DivideCurve(Curve=ln_2, Count=number_slider, Kinks=False)  # -> Points, Tangents, Parameters
item_6 = ListItem(List=divide_6.Points, Index=Slider(1, range=0..1), Wrap=True)

L_3 = ClusterOutput(ln)
L_4 = ClusterOutput(ln_2)

# ==== cluster Cluster_14
x = ClusterInput()
abs = Absolute(Value=x)
Z = UnitZ(Factor=1)
amp = Amplitude(Vector=Z, Amplitude=Slider(100, range=0..100))
multiplication = Multiplication(A=abs, B=Slider(2, range=0..10))
G = ClusterInput()
V = ClusterInput()
move = Move(Geometry=G, Motion=amp)  # -> Geometry, Transform
amp_2 = Amplitude(Vector=V, Amplitude=multiplication)
A = ClusterInput()
D = ClusterInput()
V_2 = ClusterOutput(amp_2)
ln_rot_axis = Line(StartPoint=A, EndPoint=move.Geometry)
rad = Radians(Degrees=D)
L = ClusterOutput(ln_rot_axis)
R = ClusterOutput(rad)
